# Grasshopper definition Swedge_RockBoltingOptim_template.gh (Grasshopper 1.0.7)
# plug-ins: Volvox, MetaHopper, Pufferfish, Tunny, LunchBox, Opossum2_0_Proto_A, CockroachGH, Pancake

# ----
# Step 4: Bake geometry
bake_to_sublayers_single_click = Button()
view_wedge = BooleanToggle(False)
wedge_id_integer_only_start_with_0 = Panel("test")

fit_upper_face_bench_width_with_model = Button()

# ----
# Step 2: Right click and select one point in the wedge
point_in_wedge = Point()

# ----
# Step 7 (Optional): Read to SWedge
# 
# First, open SWedge, set up a project.
# Then generate and save a copy of the SWedge automation Excel template.
write_to_swedge_excel_template_single_cl = Button()  # "Write to SWedge Excel Template? (single click)"
scale_wedge_with_volume = BooleanToggle(False)
swedge_excel_template_file_path = FilePath("C:\Users\kyc\Downloads\SWedge\SWedge Automation Template_Deterministic.xlsx")
check_path = Panel(swedge_excel_template_file_path)

manual_joint_1_phi_leave_empty_if_optimi = Panel("")  # "Manual Joint 1 phi (leave empty if optimised value to be used)"
manual_joint_2_phi_leave_empty_if_optimi = Panel("")  # "Manual Joint 2 phi (leave empty if optimised value to be used)"

output_numeric = ColourSwatch(SwatchColor=RGBA(48, 217, 138, 50))
# Results
script_wrapper = ColourSwatch(SwatchColor=RGBA(204, 204, 204, 91))
body_wrapper = ColourSwatch(SwatchColor=RGBA(217, 127, 48, 50))
output_viz = ColourSwatch(SwatchColor=RGBA(217, 115, 178, 50))
user_input = ColourSwatch(SwatchColor=RGB(255, 0, 255))
titleblock = ColourSwatch(SwatchColor=RGBA(204, 204, 204, 194))
results = ColourSwatch(SwatchColor=RGB(48, 217, 138))
input = ColourSwatch(SwatchColor=RGB(115, 190, 255))
selobj = GetSelectedObjects()  # -> ComponentObjects, ParamObjects, OtherObjects
setgroup = SetGroupProperties(Group=selobj.OtherObjects)
wiredisplay = ControlWireDisplay(WireDisplay=1)

# ---- group: Display of wedge block and cutter breps
hide_show_object_preview = HideShowObjectPreview(Visible=view_wedge, AllObjects_Object=[custom_preview, custom_preview_3, custom_preview_2, custom_preview_5])

# ---- group: CO2
co2_ø3mm = Panel("""14.43
16.17
18.23
20.28""")
co2_ø20mm = Panel("""5.35
5.80
6.60
7.85""")
co2_ø24mm = Panel("""8.59
9.59
10.89
12.62""")

# ----
# 2. VARIABLES
panel = Panel("1")

# ---- group: Time
minute_per_meter = Panel("1")
minute_per_point = Panel("30")

# ----
bolt_horizontal_rotation_deg = Slider(0, range=-20..20)
bolt_vertical_rotation_deg = Slider(0, range=-20..20)

# ----
# Variables on Sliders
bolt_diameter_class = Slider(2, range=0..2)
bolt_min_spacing_m = Slider(1, range=1..5)

bolt_2_num = Slider(1, range=0..1)
bolt_4_num = Slider(1, range=0..1)
bolt_5_num = Slider(1, range=0..1)
bolt_3_num = Slider(1, range=0..1)

# ---- group: Variables
relay = Relay([bolt_vertical_rotation_deg, bolt_horizontal_rotation_deg, bolt_min_spacing_m, bolt_2_num, bolt_3_num, bolt_4_num, bolt_5_num, bolt_diameter_class])

# ----
edge_clearance_m = Slider(1, range=0..1)
angle_tolerance_deg = Slider(10, range=0..20)
minimum_spacing_m = Panel("0.5")

# ---- group: Bolt forces / Yield load / Partial factor (1.25) (MN)
ø20mm = Panel("0.126")
ø33mm = Panel("0.333")
ø24mm = Panel("0.197")
stream_filter = StreamFilter(Gate=bolt_diameter_class, Stream0=ø20mm, Stream1=ø24mm, Stream2=ø33mm)

# ----
joint_2_friction_angle = Slider(27.084, range=0..38.542)

# ----
# 1. Lock the trigger before computing the optimisation!
trigger = Trigger(Interval=-1000, TimerInterval=1000, Target=set_slider_properties_5)

# ---- group: Larvik results 2023-02-22
fish_study4_tpe_fs_2 = Fish([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])
fish_study5_gp_fs_2 = Fish([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])
fish_study4_tpe_fs_2_paretosolutions = Fish(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)
fish_study6_nsga_fs_2_paretosolutions = Fish([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])
# Internalise optimisation iterations and Pareto Solutions as Fish components
fish_study1_tpe_maxfs = Fish([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])
fish_study2_gp_maxfs = Fish([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])
fish_study3_nsga_maxfs = Fish([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])
fish_study1_tpe_maxfs_paretosolutions = Fish([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])
fish_study2_gp_maxfs_paretosolutions = Fish([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])
fish_study3_nsga_paretosolutions = Fish([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])
fish_study6_nsga_fs_2 = Fish([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])

# ----
# 8. RESULT VISUALISATION
re_read_csv = TrueOnlyButton(LastSaveLocalization="neutral,N")

fish_larvik_tpe_test_1_2024_01_24 = Fish([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])
fish_larvik_tpe_test_2_2024_01_24 = Fish([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])

# ----
# Step 5: Create Swedge model
crest_right_control_point = Point()
move_swedge_bottom_point_x_m_below_model = Slider(0, range=0..20)  # "Move SWedge bottom point X m below model along line of intersection"
view_swedge_model_wedge_height_and_orien = BooleanToggle(True)  # "View Swedge model wedge height and orientations?"
crest_left_control_point = Point()
inner_bench_height_m = Slider(25.3, range=0..50)

hide_show_object_preview_2 = HideShowObjectPreview(Visible=view_swedge_model_wedge_height_and_orien, AllObjects_Object=[marker_dimension, line_dimension, custom_preview_6])

# ----
# Single Block Rockbolting Optimisation with Tunny
# Developed by: Jessica Ka Yi Chiu
# Last revision date: 2024-03-06
# 1. Prepare single block to be supported by rockbolting
# 2. Variables
# 3. Objectives
# 4. Attributes
# 5. Formula
# 6. Tunny optimisation components
# 7. Saving & exporting results
# 8. Result visualisation
# Colour code:
# User input
# 1. PREPARE SINGLE BLOCK TO BE SUPPORTED BY ROCKBOLTING
# Step 1: Import Point Cloud and cutters
# Recommended for a more realistic wedge geometry and volume calculation
# if wedge does not daylights.
# NB! Will result in an incorrect Swedge model geometry
point_cloud = Cloud()
clip_lower_boundary_from_cutters_geometr = BooleanToggle(False)  # "Clip lower boundary from cutters' geometry?"
view_cutter_planes = BooleanToggle(False)
_0_left_sliding_plane_from_curve_s = Curve()
_1_left_sliding_plane_from_surface = Surface()
_2_left_sliding_plane_from_obj_mesh = Mesh()
# Pre-defined values
_3_tension_crack_from_one_curve_to_verti = Curve()  # "3: Tension crack from one curve to vertical cutter"
_4_tension_crack_plane_surface = Surface()
_5_tension_crack_from_obj_mesh = Mesh()
_6_right_sliding_plane_from_curves = Curve()
_7_right_sliding_plane_from_plane_surfac = Surface()  # "7: Right sliding plane from plane surface"
_8_right_sliding_plane_from_obj_mesh = Mesh()

# ---- group: Create mesh for entire pointcloud
# Create poisson mesh from pointcloud
deconstruct_cloud = DeconstructCloud(Cloud=point_cloud)  # -> Points, Normals, Colors
cloudcreate = CloudCreate(Points=deconstruct_cloud.Points, Normals=deconstruct_cloud.Normals)
downsample = Downsample(PointCloud=cloudcreate, N="5000")
cloudnormals = CloudNormals(PointCloud=downsample, Radius="0.3", Iter=30, Neigbhours=10, D=1, Erase=True)
cloudmesh = CloudMesh(PointCloud=cloudnormals, Max=8, Min=0, Scale=1.1, Linear=False, Color=invert(False), Open3dCGAL=True)  # -> Mesh, Density
mesh = Mesh(cloudmesh.Mesh)

# ----
# Step 6: Input parameters for FS calculations
# Reset slider values in Tunny
# Generate bolting positions (takes some seconds!!)
wedge_volume_for_stability_calculation = ValueList({"3D model": 0, "SWedge model": 1, "Manual input": 2}, selected="3D model")
input_2 = ValueList({"Use 3D model joint planes": 0, "Use SWedge model joint planes": 1}, selected="Use 3D model joint planes")
view_all_available_bolt_lines_at_minimum = BooleanToggle(False)  # "View all available bolt lines at minimum spacing"
minimum_anchoring_length_m = Slider(1, range=0..3)
manual_input_volume_m3 = Panel("300")
rock_unit_weight_mn_m3 = Panel("0.0279")
joint_1_phi = Slider(42.6, range=0..55)
joint_2_phi = Slider(40.3, range=0..90)

enable_disable_object = EnableDisableObject(Enabled=view_all_available_bolt_lines_at_minimum, AllObjects_Object=bolting_point_options)

# ---- group: Create patch surface from poisson mesh boundary and filtered points
# Create patch surface from mesh
meshrepair = MeshRepair(Mesh=mesh)
mesh_edges = MeshEdges(Mesh=meshrepair)  # -> NakedEdges, InteriorEdges, NonManifoldEdges
join_curves = JoinCurves(Curves=mesh_edges.NakedEdges, Preserve=False)

# ---- group: Find optimum count UV of rebuild surface
mesh_2 = Mesh(meshrepair)
area = Area(Geometry=mesh_2)  # -> Area, Centroid
deconstruct_mesh = DeconstructMesh(Mesh=mesh_2)  # -> Vertices, Faces, Colours, Normals
list_length = ListLength(List=deconstruct_mesh.Vertices)
expression = Expression(A=area.Area, V=list_length, Expression="A/V")
expression_2 = Expression(V=list_length, Expression="sqrt(V)")

# ---- group: Create patch surface from poisson mesh boundary and filtered points (continued)
patch = Patch(Curves=join_curves, Points=deconstruct_mesh.Vertices, Spans=20, Flexibility="1", Trim=True)

# ---- group: Point deform of a rebuilt surface
rebuild_surface = RebuildSurface(Surface=patch, CountU=expression_2, CountV=expression_2)
surface_points = SurfacePoints(Surface=rebuild_surface)  # -> Points, Weights, Greville, UCount, VCount
mesh_closest_point = MeshClosestPoint(Point=surface_points.Points, Mesh=meshrepair)  # -> Point, Index, Parameter
vector_2pt = Vector2Pt(PointA=surface_points.Points, PointB=mesh_closest_point.Point, Unitize=False)  # -> Vector, Length
point_deform = PointDeform(Geometry=rebuild_surface, Points=surface_points.Points, Motion=vector_2pt.Vector)
patch_surface = Brep(point_deform)

# ----
volume_calculation = VolumeCalculation(
    patch_surface=patch_surface,
    point_cloud=point_cloud,
    _0_left_sliding_plane_from_curve_s=_0_left_sliding_plane_from_curve_s,
    _1_left_sliding_plane_from_surface=_1_left_sliding_plane_from_surface,
    _2_left_sliding_plane_from_obj_mesh=_2_left_sliding_plane_from_obj_mesh,
    _3_tension_crack_from_one_curve_to_verti=_3_tension_crack_from_one_curve_to_verti,
    _4_tension_crack_plane_surface=_4_tension_crack_plane_surface,
    _5_tension_crack_from_obj_mesh=_5_tension_crack_from_obj_mesh,
    _6_right_sliding_plane_from_curves=_6_right_sliding_plane_from_curves,
    _7_right_sliding_plane_from_plane_surfac=_7_right_sliding_plane_from_plane_surfac,
    _8_right_sliding_plane_from_obj_mesh=_8_right_sliding_plane_from_obj_mesh,
    point_in_wedge=point_in_wedge,
    clip_lower_boundary=clip_lower_boundary_from_cutters_geometr)  # -> check_number_of_left_sliding_plane_geome_2, check_tension_crack_geometry_2, check_number_of_right_sliding_plane_geom_2, brep_2_volume_2, left_joint_trimmed_cutter_brep_2, right_joint_trimmed_cutter_brep_2, tension_crack_trimmed_cutter_brep_2, block_slope_surface_2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
swedge_model_and_geometries = SwedgeModelAndGeometries(
    left_joint_trimmed_cutter_brep=volume_calculation.left_joint_trimmed_cutter_brep_2,
    right_joint_trimmed_cutter_brep=volume_calculation.right_joint_trimmed_cutter_brep_2,
    crest_left_control_point=crest_left_control_point,
    crest_right_control_point=crest_right_control_point,
    inner_bench_height=inner_bench_height_m,
    fit_top_face_bench_width_to_model=fit_upper_face_bench_width_with_model,
    swedge_bottom_point_adjustment_m=move_swedge_bottom_point_x_m_below_model)  # -> swedge_model_mesh, upper_face_mesh_2, slope_face_mesh_2, left_joint_face_mesh_2, right_joint_face_mesh_2, wedge_height_line_2, wedge_height_m_2, inner_bench_height_m_2
volume = Volume(Geometry=swedge_model_and_geometries.swedge_model_mesh)  # -> Volume, Centroid
bake_wedgeto_sublayers = BakeWedgetoSublayers(
    wedge_id_integer=wedge_id_integer_only_start_with_0,
    bake_to_sublayers=bake_to_sublayers_single_click,
    brep_2_volume=volume_calculation.brep_2_volume_2,
    volume_m3=volume_calculation.volume_m3_2,
    block_left_sliding_mesh=volume_calculation.left_joint_trimmed_cutter_brep_2,
    block_right_sliding_mesh=volume_calculation.right_joint_trimmed_cutter_brep_2,
    block_slope_surface=volume_calculation.block_slope_surface_2,
    block_tension_crack_mesh=volume_calculation.tension_crack_trimmed_cutter_brep_2)

# ----
# Step 3: Calculate volume
volume_m3 = Panel(volume_calculation.volume_m3_2)

check_number_of_left_sliding_plane_geome = Panel(volume_calculation.check_number_of_left_sliding_plane_geome_2)  # "Check: number of left sliding plane geometry"
check_tension_crack_geometry = Panel(volume_calculation.check_tension_crack_geometry_2)
check_number_of_right_sliding_plane_geom = Panel(volume_calculation.check_number_of_right_sliding_plane_geom_2)  # "Check: Number of right sliding plane geometry"

swedge_model_volume_m3 = Panel(volume.Volume)

swedge_wedge_height_m = Panel(swedge_model_and_geometries.wedge_height_m_2)

pick_n_choose = PickNChoose(
    Pattern=wedge_volume_for_stability_calculation,
    Stream0=volume_m3,
    Stream1=swedge_model_volume_m3,
    Stream2=manual_input_volume_m3)
input_volume_m3 = Panel(pick_n_choose)

# ---- group: Wedge Height adjustment
get_selected_objects = GetSelectedObjects(AllObjects_Object=inner_bench_height_m)  # -> ComponentObjects, ParamObjects, OtherObjects
set_slider_properties = SetSliderProperties(
    Slider=get_selected_objects.ParamObjects,
    Value=swedge_model_and_geometries.inner_bench_height_m_2,
    Range="0 to 50",
    Type=0)

# ---- group: Display Slope Faces Dip/Dip Direction
panel_2 = Panel("True")
panel_3 = Panel("0")
entwine = Entwine(
    Branch00=swedge_model_and_geometries.upper_face_mesh_2,
    Branch01=swedge_model_and_geometries.slope_face_mesh_2,
    FlattenInputs=True)
mesh_dip_dipdirection = MeshDipDipDirection_2(mesh=entwine, round_to_nearest=panel_2, no_of_decimal_place=panel_3)  # -> dip_deg_2, dip_direction_deg_2, dip_dipdirection_2
face_normals = FaceNormals(Mesh=entwine)  # -> Centers, Normals
line_sdl = LineSDL(Start=face_normals.Centers, Direction=face_normals.Normals, Length="2")  # -> flatten(Line)
explode_tree = ExplodeTree(Data=graft(mesh_dip_dipdirection.dip_deg_2))  # -> Branch0, Branch1
explode_tree_2 = ExplodeTree(Data=graft(mesh_dip_dipdirection.dip_direction_deg_2))  # -> Branch0, Branch1
marker_dimension = MarkerDimension(Line=line_sdl, Text=mesh_dip_dipdirection.dip_dipdirection_2, Size=1)

# ---- group: Joint 1
mesh_dip_dipdirection_2 = MeshDipDipDirection_2(mesh=volume_calculation.left_joint_trimmed_cutter_brep_2, round_to_nearest=panel_2, no_of_decimal_place=panel_3)  # -> dip_deg_2, dip_direction_deg_2, dip_dipdirection_2

# ---- group: Joint 2
mesh_dip_dipdirection_3 = MeshDipDipDirection_2(mesh=volume_calculation.right_joint_trimmed_cutter_brep_2, round_to_nearest=panel_2, no_of_decimal_place=panel_3)  # -> dip_deg_2, dip_direction_deg_2, dip_dipdirection_2

# ---- group: Tension Crack
mesh_dip_dipdirection_4 = MeshDipDipDirection_2(mesh=volume_calculation.tension_crack_trimmed_cutter_brep_2, round_to_nearest=panel_2, no_of_decimal_place=panel_3)  # -> dip_deg_2, dip_direction_deg_2, dip_dipdirection_2

# ----
write_to_swedge = WriteToSWedge(
    scale_wedge_with_volume=scale_wedge_with_volume,
    write_to_excel_template=write_to_swedge_excel_template_single_cl,
    file_path=swedge_excel_template_file_path,
    wedgeid=wedge_id_integer_only_start_with_0,
    joint1_dip=mesh_dip_dipdirection_2.dip_deg_2,
    joint1_dip_direction=mesh_dip_dipdirection_2.dip_direction_deg_2,
    joint_1_phi=joint_1_phi,
    joint_2_phi=joint_2_phi,
    slope_dip=explode_tree.Branch1,
    slope_dip_direction=explode_tree_2.Branch1,
    joint2_dip=mesh_dip_dipdirection_3.dip_deg_2,
    wedge_height=swedge_model_and_geometries.wedge_height_m_2,
    joint2_dip_direction=mesh_dip_dipdirection_3.dip_direction_deg_2,
    upper_face_dip=explode_tree.Branch0,
    upper_face_dip_direction=explode_tree_2.Branch0,
    volume=pick_n_choose,
    tension_crack_dip=mesh_dip_dipdirection_4.dip_deg_2,
    tension_crack_dipdirection=mesh_dip_dipdirection_4.dip_direction_deg_2,
    rock_unit_weight=rock_unit_weight_mn_m3)

# ---- group: Wedge slope surface
colour_picker = ColourPicker(PickedColour=RGBA(0, 170, 0, 135))
custom_preview = CustomPreview(Geometry=volume_calculation.block_slope_surface_2, Material=colour_picker)

# ---- group: Right Joint Trimmed Cutter Brep
colour_picker_2 = ColourPicker(PickedColour=RGBA(0, 0, 255, 135))
custom_preview_2 = CustomPreview(Geometry=volume_calculation.tension_crack_trimmed_cutter_brep_2, Material=colour_picker_2)

# ---- group: Left Joint Trimmed Cutter Brep
colour_picker_3 = ColourPicker(PickedColour=RGBA(255, 0, 0, 135))
custom_preview_3 = CustomPreview(Geometry=volume_calculation.left_joint_trimmed_cutter_brep_2, Material=colour_picker_3)

# ---- group: Cutter planes
colour_picker_4 = ColourPicker(PickedColour=RGB(255, 255, 255))
custom_preview_4 = CustomPreview(Geometry=volume_calculation.cutter_planes_brep_2, Material=colour_picker_4)
hide_show_object_preview_3 = HideShowObjectPreview(Visible=view_cutter_planes, AllObjects_Object=custom_preview_4)

# ---- group: Tension Crack Joint Trimmed Cutter Brep
colour_picker_5 = ColourPicker(PickedColour=RGBA(255, 255, 0, 135))
custom_preview_5 = CustomPreview(Geometry=volume_calculation.right_joint_trimmed_cutter_brep_2, Material=colour_picker_5)

# ---- group: Swedge model
colour_picker_6 = ColourPicker(PickedColour=RGB(255, 0, 0))
mesh_edges_2 = MeshEdges(Mesh=swedge_model_and_geometries.swedge_model_mesh)  # -> NakedEdges, InteriorEdges, NonManifoldEdges
custom_preview_6 = CustomPreview(Geometry=mesh_edges_2.InteriorEdges, Material=colour_picker_6)

# ---- group: Display Wedge Height
round_to_decimal_place = RoundToDecimalPlace(NumberX=swedge_model_and_geometries.wedge_height_m_2, DecimalPlace="1", RoundType=0)  # -> Rounded, Difference
line_dimension = LineDimension(Line=swedge_model_and_geometries.wedge_height_line_2, Text=round_to_decimal_place.Rounded, Size=Slider(0.8, range=0..1))

# ---- group: Get Trend/Plunge after bolt rotation
bolt_rotation = BoltRotation(
    slope_face_dip_deg=explode_tree.Branch1,
    slope_face_dip_direction_deg=explode_tree_2.Branch1,
    base=volume_calculation.wedge_bottom_point_2,
    bolt_plunge_rotation_deg=bolt_vertical_rotation_deg,
    bolt_trend_rotation_deg=bolt_horizontal_rotation_deg)  # -> bolt_direction_2, plunge_2, trend_2
bolt_trend = Panel(bolt_rotation.trend_2)
bolt_plunge = Panel(bolt_rotation.plunge_2)

# ----
# 2. Get available bolting points depending on block geometry and Point Cloud
library_of_bolt_length_m = Panel("""2.4
3
4
5""")
cloudnormals_2 = CloudNormals(PointCloud=cloudcreate, Radius="0.3", Iter=30, Neigbhours=10, D=1, Erase=True)
pointcloud_subparallel_to_swedge_slope_s = PointCloudSubparallelToSWedgeSlopeSurface(
    pointcloud_with_normals=cloudnormals_2,
    swedge_slope_face_mesh=swedge_model_and_geometries.slope_face_mesh_2,
    block_slope_surface=volume_calculation.block_slope_surface_2,
    angle_tolerance_deg=angle_tolerance_deg)  # "PointCloud Subparallel to SWedge Slope Surface"
bolting_point_options = AvailableBoltPointsAndLines(
    points_subparallel_with_swedge_slope_fac=pointcloud_subparallel_to_swedge_slope_s,
    edge_clearance_m=edge_clearance_m,
    block_slope_face=volume_calculation.block_slope_surface_2,
    swedge_model_slope_face_mesh=swedge_model_and_geometries.slope_face_mesh_2,
    swedge_model_centroid=volume.Centroid,
    bolting_point_minimum_spacing_m=minimum_spacing_m)  # disabled
available_bolt_lines = AvailableBoltPointsAndLines_2(
    minimum_anchoring_length_m=minimum_anchoring_length_m,
    bolting_point_options=bolting_point_options,
    swedge_model_slope_face_mesh=swedge_model_and_geometries.slope_face_mesh_2,
    left_joint_trimmed_cutter_brep=volume_calculation.left_joint_trimmed_cutter_brep_2,
    right_joint_trimmed_cutter_brep=volume_calculation.right_joint_trimmed_cutter_brep_2,
    tension_crack_trimmed_cutter_brep=volume_calculation.tension_crack_trimmed_cutter_brep_2,
    library_of_bolt_lengths_m=library_of_bolt_length_m,
    bolting_point_spacing_m=bolt_min_spacing_m,
    bolt_direction=bolt_rotation.bolt_direction_2)  # -> available_bolt_points_numbers_grouped_by_2, available_bolt_lines_2
available_bolt_points_numbers_grouped_by = Panel(available_bolt_lines.available_bolt_points_numbers_grouped_by_2)  # "Available bolt points numbers grouped by lengths"

available_bolt_lines_2 = Panel(available_bolt_lines.available_bolt_points_numbers_grouped_by_2)

# ---- group: Choose joint plane for FS calculations / 3D model
entwine_2 = Entwine(
    Branch00=volume_calculation.left_joint_trimmed_cutter_brep_2,
    Branch01=volume_calculation.right_joint_trimmed_cutter_brep_2,
    FlattenInputs=True)
mesh_brep = MeshBrep(
    Brep=entwine_2,
    Settings={GridMaxCount=0, GridMinCount=16, JaggedSeams=False, MaxEdgeLength=0, MinEdgeLength=0.0001, MinTolerance=0, Refine=True, RefineAngle=0, RelativeTolerance=0.65, SimplePlanes=True, Tolerance=0})  # -> simplify(Mesh)

# ---- group: Choose joint plane for FS calculations / SWedge moel
entwine_3 = Entwine(
    Branch00=swedge_model_and_geometries.left_joint_face_mesh_2,
    Branch01=swedge_model_and_geometries.right_joint_face_mesh_2,
    FlattenInputs=True)  # -> simplify(Result)

# ---- group: Choose joint plane for FS calculations
pick_n_choose_2 = PickNChoose(Pattern=input_2, Stream0=mesh_brep, Stream1=entwine_3)

# ---- group: Available bolt lines
colour_picker_7 = ColourPicker(PickedColour=RGB(0, 0, 255))
custom_preview_7 = CustomPreview(Geometry=available_bolt_lines.available_bolt_lines_2, Material=colour_picker_7)
hide_show_object_preview_4 = HideShowObjectPreview(Visible=view_all_available_bolt_lines_at_minimum, AllObjects_Object=custom_preview_7)

# ---- group: Constructing sliders for variables
bolt_rotation_angle_range_deg = Slider(20, range=0..100)
max_bolt_diameter_class = Slider(2, range=0..10)
max_allowed_bolt_spacing_m = Slider(5, range=0..10)
min_allowed_bolt_spacing_m = Slider(1, range=0..10)
negative = Negative(Value=bolt_rotation_angle_range_deg)
construct_domain = ConstructDomain(DomainStart=negative, DomainEnd=bolt_rotation_angle_range_deg)
construct_domain_2 = ConstructDomain(DomainStart="0", DomainEnd=max_bolt_diameter_class)
construct_domain_3 = ConstructDomain(DomainStart="0", DomainEnd=panel)
construct_domain_4 = ConstructDomain(DomainStart=min_allowed_bolt_spacing_m, DomainEnd=max_allowed_bolt_spacing_m)
explode_tree_3 = ExplodeTree(Data=construct_domain_3)  # -> Branch0, Branch1, Branch2, Branch3
entwine_4 = Entwine(
    Branch00=construct_domain,
    Branch01=construct_domain,
    Branch02=explode_tree_3.Branch0,
    Branch03=explode_tree_3.Branch0,
    Branch04=explode_tree_3.Branch0,
    Branch05=explode_tree_3.Branch0,
    Branch06=construct_domain_2,
    Branch07=construct_domain_4,
    FlattenInputs=True)  # -> flatten(Result)
float = Panel("0")
integer = Panel("1")
domains = Panel(entwine_4)
entwine_5 = Entwine(
    Branch00=float,
    Branch01=float,
    Branch02=float,
    Branch03=float,
    Branch04=float,
    Branch05=float,
    Branch06=integer,
    Branch07=float,
    FlattenInputs=True)  # -> flatten(Result)
get_selected_objects_2 = GetSelectedObjects(AllObjects_Object=[bolt_vertical_rotation_deg, bolt_horizontal_rotation_deg, bolt_2_num, bolt_3_num, bolt_4_num, bolt_5_num, bolt_diameter_class, bolt_min_spacing_m])  # -> ComponentObjects, ParamObjects, OtherObjects

# ---- group: FS
# 3. OBJECTIVES
# 1. Factor of Safety
fs_min = Slider(1, range=0..4)

# ---- group: Calculate embedment length
brep_join = BrepJoin(Breps=flatten([volume_calculation.left_joint_trimmed_cutter_brep_2, volume_calculation.right_joint_trimmed_cutter_brep_2]))  # -> Breps, Closed

# ---- group: FS / Minimum FS (>/= 1)
# 1. Alternative 1: minimum FS (at least 1)
panel_4 = Panel("0")

# ---- group: CO2
# 2. CO2
stream_filter_2 = StreamFilter(Gate=bolt_diameter_class, Stream0=co2_ø20mm, Stream1=co2_ø24mm, Stream2=co2_ø3mm)

# ---- group: Time
# 3. Time
minute_per_meter_2 = Number(minute_per_meter)
minute_per_point_2 = Number(minute_per_point)

# ----
_1st_slider_values = Panel("""0
0
1
1
1
1
2
1""")

# ----
# 3. Rockbolting calculations - orientation; lengths; forces
available_bolt_points_grouped_by_lengths = Integer(available_bolt_lines.available_bolt_points_numbers_grouped_by_2)

# ---- group: Number of bolts for different lengths
entwine_6 = Entwine(Branch00=bolt_2_num, Branch01=bolt_3_num, Branch02=bolt_4_num, Branch03=bolt_5_num, FlattenInputs=True)  # -> simplify(Result)
remap_numbers = RemapNumbers(Value=entwine_6, Source=Domain(0, 1), Target=available_bolt_points_grouped_by_lengths)  # -> Mapped, Clipped
round = Round(Number=remap_numbers.Mapped)  # -> Nearest, Floor, Ceiling

# ----
num = Integer(round.Nearest)

# ---- group: CO2 (continued)
expression_3 = Expression(num=num, CO2=graft(stream_filter_2), Expression="(num*CO2)")
mass_addition = MassAddition(Input=flatten(expression_3))  # -> Result, PartialResults

co2 = Number(mass_addition.Result)
panel_5 = Panel(co2)

# ---- group: Number of bolts for different lengths (continued)
mass_addition_2 = MassAddition(Input=flatten(num))  # -> Result, PartialResults
number_of_bolts_for_each_length = Panel(num)

# ---- group: Bolt forces
expression_4 = Expression(num=mass_addition_2.Result, bolt_capacity=stream_filter, Expression="num*bolt_capacity")
of_yield_load_for_pretensioning = Panel("0.6")
multiplication = Multiplication(A=expression_4, B=of_yield_load_for_pretensioning)
passive_bolt_force_mn = Panel(expression_4)
active_bolt_force_mn = Panel(multiplication)

# ----
# Bolt visualisations with different bolt plate geometry depending on bolt lengths:
# - 2.4 m = 12-sided polygon
# - 3 m    = triangle
# - 4 m    = square
# - 5 m    = 5-sided plolygon
filter_bolts_by_number = FilterBoltsByNumber(
    wedge_centroid=volume_calculation.wedge_centroid_2,
    swedge_slope_face_mesh=swedge_model_and_geometries.slope_face_mesh_2,
    number_of_bolts_each_length=num)  # -> bolt_lines_2, bolt_plates_2
colour_picker_8 = ColourPicker(PickedColour=RGB(0, 0, 0))
custom_preview_8 = CustomPreview(Geometry=[filter_bolts_by_number.bolt_plates_2, filter_bolts_by_number.bolt_lines_2], Material=colour_picker_8)

# ---- group: Calculate embedment length (continued)
bolt_lines = Line(filter_bolts_by_number.bolt_lines_2)
brep_line = BrepLine(Brep=brep_join.Breps, Line=flatten(bolt_lines), LimitToFirst=False)  # -> Curves, flatten(Points)
end_points = EndPoints(Curve=flatten(bolt_lines))  # -> Start, End
line = Line(StartPoint=brep_line.Points, EndPoint=end_points.End)
length = Length(Curve=line)
larger_than = LargerThan(FirstNumber=length, SecondNumber="1")  # -> LargerThan, OrEqualTo
mass_multiplication = MassMultiplication(Input=larger_than.OrEqualTo)  # -> Result, PartialResults
mass_addition_3 = MassAddition(Input=length)  # -> Result, PartialResults
check_embedment_length_1_m = Integer(mass_multiplication.Result)
total_embedment_length = Number(mass_addition_3.Result)

# ---- group: Time (continued)
bolt_lines_2 = Line(filter_bolts_by_number.bolt_lines_2)
length_2 = Length(Curve=bolt_lines_2)
mass_addition_4 = MassAddition(Input=flatten(length_2))  # -> Result, PartialResults

# ---- group: Time / Set to L=0 if not bolt can be drawn
null_item = NullItem(Item=mass_addition_4.Result)  # -> NullFlags, InvalidFlags, Description
stream_filter_3 = StreamFilter(Gate=null_item.NullFlags, Stream0=mass_addition_4.Result, Stream1="0")

# ---- group: Time (continued)
expression_5 = Expression(
    num=mass_addition_2.Result,
    L=stream_filter_3,
    Drill_time=minute_per_meter_2,
    Point_time=minute_per_point_2,
    Expression="(num*Point_time+L*Drill_time)/60")

# ----
hours = Number(expression_5)
panel_6 = Panel(hours)

# ----
# 4. ATTRIBUTES
explode_tree_4 = ExplodeTree(Data=round.Nearest)  # -> Branch0, Branch1, Branch2, Branch3

# ----
# 1. Set minimum FS, then run the optimisation
opossum = Opossum(
    OpossumData_OptimizationType=2,
    OpossumData_ResultSerializationStatus=0,
    OpossumData_objective=fs_proxy,
    OpossumData_variable=[cohesion, joint_1_friction_angle])
fs_min_2 = Slider(1, range=0..4)
joint_1_friction_angle = Slider(35.551, range=0..39.419)
explode_tree_5 = ExplodeTree(Data=pick_n_choose_2)  # -> Branch0, Branch1

# ---- group: Choose friction angles based on inputs
entwine_7 = Entwine(Branch00=manual_joint_1_phi_leave_empty_if_optimi, Branch01=manual_joint_2_phi_leave_empty_if_optimi, FlattenInputs=True)  # -> simplify(Result)
entwine_8 = Entwine(Branch00=joint_1_friction_angle, Branch01=joint_2_friction_angle, FlattenInputs=True)  # -> simplify(Result)
text_length = TextLength(Text=entwine_7)
equality = Equality(FirstNumber=text_length, SecondNumber="0")  # -> flatten(Equality), Inequality
pick_n_choose_3 = PickNChoose(Pattern=equality.Equality, Stream0=flatten(entwine_7), Stream1=flatten(entwine_8))

# ----
explode_tree_6 = ExplodeTree(Data=simplify(graft(pick_n_choose_3)))  # -> Branch0, Branch1
phi_2 = Number(explode_tree_6.Branch1)

# ---- group: Joint friction angle: Optimisation within 0 and minimum joint dip angle; then update the slider automatically
brep_brep = BrepBrep(BrepA=volume_calculation.left_joint_trimmed_cutter_brep_2, BrepB=volume_calculation.right_joint_trimmed_cutter_brep_2)  # -> Curves, Points
find_vector_plunge_trend = Cluster(vector=brep_brep.Curves)  # -> trend_2, plunge_2
absolute = Absolute(Value=find_vector_plunge_trend.plunge_2)
construct_domain_5 = ConstructDomain(DomainStart="0", DomainEnd=absolute)

# ----
get_selected_objects_3 = GetSelectedObjects(AllObjects_Object=joint_1_friction_angle)  # -> ComponentObjects, ParamObjects, OtherObjects
cohesion = Slider(0, range=0..2)
set_slider_properties_2 = SetSliderProperties(Slider=get_selected_objects_3.ParamObjects, Range=construct_domain_5, Type=0)

phi_1 = Number(explode_tree_6.Branch0)

# ---- group: Joint friction angle: Optimisation within 0 and minimum joint dip angle; then update the slider automatically (continued)
joint_friction_angles = Panel([phi_1, phi_2])

# ---- group: Calculate residual friction angle. Assuming 3 degrees smaller.
subtraction = Subtraction(A=phi_1, B="3")
subtraction_2 = Subtraction(A=phi_2, B="3")

# ----
# 5. FORMULA
apply_material_partial_factor = ApplyMaterialPartialFactor(c_1=cohesion, phi_1=phi_1, phi_1_r=subtraction, c_2=cohesion, phi_2=phi_2, phi_2_r=subtraction_2)  # -> c_1_4, phi_1_4, phi_1_r_4, c_2_4, phi_2_4, phi_2_r_4

cluster = Cluster_3(
    gamma_r=rock_unit_weight_mn_m3,
    V=pick_n_choose,
    a_t=0,
    wedge_left_joint_mesh=explode_tree_5.Branch0,
    wedge_right_joint_mesh=explode_tree_5.Branch1,
    wedge_slope_face_mesh=swedge_model_and_geometries.slope_face_mesh_2,
    wedge_upper_face_mesh=swedge_model_and_geometries.upper_face_mesh_2,
    left_joint_dip=mesh_dip_dipdirection_2.dip_deg_2,
    left_joint_dip_direction=mesh_dip_dipdirection_2.dip_direction_deg_2,
    right_joint_dip=mesh_dip_dipdirection_3.dip_deg_2,
    right_joint_dip_direction=mesh_dip_dipdirection_3.dip_direction_deg_2,
    slope_dip=explode_tree.Branch1,
    slope_dip_direction=explode_tree_2.Branch1,
    c_1=apply_material_partial_factor.c_1_4,
    phi_1=apply_material_partial_factor.phi_1_4,
    phi_1_r=apply_material_partial_factor.phi_1_r_4,
    c_2=apply_material_partial_factor.c_2_4,
    phi_2=apply_material_partial_factor.phi_2_4,
    phi_2_r=apply_material_partial_factor.phi_2_r_4,
    k=0,
    e_cap_seismic="{0,0,0}",
    joint_water_pressure=0,
    c_active=0,
    e_cap_bolt_active="{0,0,0}",
    c_passive=0,
    e_cap_bolt_passive="{0,0,0}")  # -> fs_system_2, fs_s_2, fs_c_2, shear_failure_sliding_direction_2
expression_6 = Expression(FS=cluster.fs_system_2, FS_min=fs_min_2, Expression="Abs(FS-FS_min)")
fs_proxy = Number(expression_6)
panel_7 = Panel(cluster.fs_system_2)

# ----
# 4. Calculate Fator of Safety of Wedge
cluster_2 = Cluster_3(
    gamma_r=rock_unit_weight_mn_m3,
    V=pick_n_choose,
    a_t=0,
    wedge_left_joint_mesh=explode_tree_5.Branch0,
    wedge_right_joint_mesh=explode_tree_5.Branch1,
    wedge_slope_face_mesh=swedge_model_and_geometries.slope_face_mesh_2,
    wedge_upper_face_mesh=swedge_model_and_geometries.upper_face_mesh_2,
    left_joint_dip=mesh_dip_dipdirection_2.dip_deg_2,
    left_joint_dip_direction=mesh_dip_dipdirection_2.dip_direction_deg_2,
    right_joint_dip=mesh_dip_dipdirection_3.dip_deg_2,
    right_joint_dip_direction=mesh_dip_dipdirection_3.dip_direction_deg_2,
    slope_dip=explode_tree.Branch1,
    slope_dip_direction=explode_tree_2.Branch1,
    c_1=apply_material_partial_factor.c_1_4,
    phi_1=apply_material_partial_factor.phi_1_4,
    phi_1_r=apply_material_partial_factor.phi_1_r_4,
    c_2=apply_material_partial_factor.c_2_4,
    phi_2=apply_material_partial_factor.phi_2_4,
    phi_2_r=apply_material_partial_factor.phi_2_r_4,
    k=0,
    e_cap_seismic="{0,0,0}",
    joint_water_pressure=0,
    c_active=multiplication,
    e_cap_bolt_active=bolt_rotation.bolt_direction_2,
    c_passive=expression_4,
    e_cap_bolt_passive=bolt_rotation.bolt_direction_2)  # -> fs_system_2, fs_s_2, fs_c_2, shear_failure_sliding_direction_2
fs_system = Panel(cluster_2.fs_system_2)

# ---- group: FS (continued)
fs_system_2 = Number(cluster_2.fs_system_2)

# ---- group: FS / Minimum FS (>/= 1) (continued)
subtraction_3 = Subtraction(A=fs_system_2, B=fs_min)
smaller_than = SmallerThan(FirstNumber=subtraction_3, SecondNumber=panel_4)  # -> SmallerThan, OrEqualTo
expression_7 = Expression(FS=subtraction_3, Expression="Abs(FS)*1000")
pick_n_choose_4 = PickNChoose(Pattern=smaller_than.OrEqualTo, Stream0=subtraction_3, Stream1=expression_7)
minfs = Number(pick_n_choose_4)

# ---- group: Calculate constraints (>0 means constraint violated)
subtraction_4 = Subtraction(FS_min=fs_min, FS_system=cluster_2.fs_system_2)

# ---- group: FS / FS converging to 1 (not used)
# 1. Alternative 2: FS converging to 1 (not used)
expression_8 = Expression(FS=fs_system_2, FS_min=fs_min, Expression="Abs(FS-FS_min)")  # disabled

number = Number(expression_8)  # disabled
panel_8 = Panel(number)  # disabled

# ----
construct_fish_attribute = ConstructFishAttribute(
    Constraint=subtraction_4,
    Attr1=cluster_2.fs_system_2,
    Bolt_plunge=bolt_rotation.plunge_2,
    Bolt_trend=bolt_rotation.trend_2,
    Bolt_2_num=explode_tree_4.Branch0,
    Bolt_3_num=explode_tree_4.Branch1,
    Bolt_4_num=explode_tree_4.Branch2,
    Bolt_5_num=explode_tree_4.Branch3,
    Tot_bolt_num=mass_addition_2.Result,
    Tot_embed_length=total_embedment_length,
    Embed_length_passed=check_embedment_length_1_m)

# ---- group: Objectives min positive FS
relay_2 = Relay([minfs, co2, hours])

# ---- group: Objectives FS=1
relay_3 = Relay([number, co2, hours])

# ----
# 6. TUNNY OPTIMISATION COMPONENTS
# 2. Reset Slider values
# 3. Clear Eggs
# 4. Lay Eggs
# 5. Double click Tunny component to set up and start the optimisation
clear_egg = Button()
reset_slider_values = Button()
lay_egg = Button()
construct_fish_egg = ConstructFishEgg(
    Variables=[bolt_vertical_rotation_deg, bolt_horizontal_rotation_deg, bolt_2_num, bolt_3_num, bolt_4_num, bolt_5_num, bolt_diameter_class, bolt_min_spacing_m],
    LayEgg=lay_egg,
    Clear=clear_egg)
fishegg = Panel(construct_fish_egg)
tunny = Tunny(
    Variables=[construct_fish_egg, bolt_vertical_rotation_deg, bolt_horizontal_rotation_deg, bolt_min_spacing_m, bolt_2_num, bolt_3_num, bolt_4_num, bolt_5_num, bolt_diameter_class],
    Objectives=[minfs, co2, hours],
    Attributes=construct_fish_attribute)

pick_n_choose_5 = PickNChoose(Pattern=reset_slider_values, Stream1=graft(_1st_slider_values))  # -> flatten(Result)

# ---- group: Constructing sliders for variables (continued)
set_slider_properties_3 = SetSliderProperties(Slider=get_selected_objects_2.ParamObjects, Value=pick_n_choose_5, Range=entwine_4, Type=entwine_5)

# ---- group: Exporting Fish data to .csv
# 1. Export results to Fish in Tunny
# Source:
# https://github.com/jhorikawa/GrasshopperProgrammingTutorials/blob/master/0012%20Export%20CSV%20with%20C%23%20for%20Grasshopper/CSVExport.gh
# 2. Select folder directory and write file name
# 3. click the button to save the csv file (NB!! Overwritable!)
# 4. Export Pareto results to Fish in Tunny,
# Then click button
panel_9 = Panel("C:\Users\KYC\Downloads\Tunny_test_2024-03-06\")
fish_to_csv = FishToCSV(fish=tunny)  # -> flatten(csv_string_2)
save_pareto_solutions_to_csv = Button()
save_to_csv = Button()
file_path = FilePath(panel_9)
file_name = Panel("TPE-test-0.csv")
concatenate = Concatenate(FragmentA=file_path, FragmentB=file_name)
c_write_to_csv = CSharpScript(save=save_to_csv, path=concatenate, data=fish_to_csv)  # inputs save: Boolean, path: String, data: list of String; same code as c_write_to_csv
update_csv_fie_with_pareto_booleans = UpdateCSVFieWithParetoBooleans(fish_paretosolutions=tunny, csv_file_path=concatenate, update_csv_with_pareto_booleans=save_pareto_solutions_to_csv)

# ----
# 7. SAVING & EXPORTING RESULTS
fish = Fish(tunny)

# ---- group: From CSV file to correct sliders values / Get variable names in CSV file order
read_file = ReadFile(File=concatenate, PerLineParse=True)  # disabled
enable_disable_object_2 = EnableDisableObject(Enabled=re_read_csv, AllObjects_Object=read_file)
read_csv = ReadCSV(CSVString=read_file, Delimiter=",")  # -> Headers, Values
panel_10 = Panel("""4
5
6
7
8
9
10
11""")
list_item = ListItem(List=read_csv.Headers, Index=panel_10, Wrap=True)
text_fragment = TextFragment(Text=list_item, Start="4")

# ---- group: Update slider range for visualisation
get_selected_objects_4 = GetSelectedObjects(AllObjects_Object=trial_no)  # -> ComponentObjects, ParamObjects, OtherObjects
flip_matrix = FlipMatrix(Data=read_csv.Values)
tree_statistics = TreeStatistics(Tree=flip_matrix)  # -> Paths, Length, Count
last_index = LastIndex(List=tree_statistics.Paths)
construct_domain_6 = ConstructDomain(DomainStart=0, DomainEnd=last_index)
set_slider_properties_4 = SetSliderProperties(Slider=get_selected_objects_4.ParamObjects, Range=construct_domain_6, Type=1)

# ---- group: From CSV file to correct sliders values / Match with variable names in Sliders' order
get_slider_properties = GetSliderProperties(Slider=get_selected_objects_2.ParamObjects)  # -> NickName, Value, Range, Type, DecimalPlaces
match_text = MatchText(Text=text_fragment, Pattern=graft(get_slider_properties.NickName), Case=True)

# ---- group: From CSV file to correct sliders values / Order of CSV index as in Sliders
list_indices = ListIndices(List=match_text)
cull_pattern = CullPattern(List=list_indices, CullPattern=match_text)  # -> flatten(List)

# ----
# Unlock the trigger for updating the slider values
trial_no = Slider(0, range=0..9)
view_bolts = BooleanToggle(False)
hide_show_object_preview_5 = HideShowObjectPreview(Visible=view_bolts, AllObjects_Object=custom_preview_8)

# ---- group: From CSV file to correct sliders values / Retrieve from Trial ID
list_item_2 = ListItem(List=read_csv.Values, Index=trial_no, Wrap=True)  # -> flatten(Item)

# ---- group: From CSV file to correct sliders values / Reorder variable values
list_item_3 = ListItem(List=list_item_2, Index=panel_10, Wrap=True)
list_item_4 = ListItem(List=list_item_3, Index=cull_pattern, Wrap=True)

# ----
set_slider_properties_5 = SetSliderProperties(Slider=get_selected_objects_2.ParamObjects, Value=list_item_4, Range=entwine_4, Type=entwine_5)  # disabled

# ==== cluster VolumeCalculation
patch_surface = ClusterInput()
point_cloud = ClusterInput()
_1_left_sliding_plane_from_surface = ClusterInput()
_2_left_sliding_plane_from_obj_mesh = ClusterInput()
_0_left_sliding_plane_from_curve_s = ClusterInput()
clip_lower_boundary = ClusterInput()
point_in_wedge = ClusterInput()
clip_lower_boundary_2 = Boolean(clip_lower_boundary)
point_in_wedge_2 = Point(point_in_wedge)
_3_tension_crack_from_one_curve_to_verti = ClusterInput()  # "3: Tension crack from one curve to vertical cutter"
_4_tension_crack_plane_surface = ClusterInput()
_5_tension_crack_from_obj_mesh = ClusterInput()
_7_right_sliding_plane_from_plane_surfac = ClusterInput()  # "7: Right sliding plane from plane surface"
_8_right_sliding_plane_from_obj_mesh = ClusterInput()
_6_right_sliding_plane_from_curves = ClusterInput()
patch_surface_2 = Brep(patch_surface)

# ----
# Step 1: Import Point Cloud and cutters and select
point_cloud_2 = Cloud(point_cloud)
# Only one type of geometry
_0_left_sliding_plane_from_curve_s_2 = Curve(_0_left_sliding_plane_from_curve_s)
_1_left_sliding_plane_from_surface_2 = Surface(_1_left_sliding_plane_from_surface)
_2_left_sliding_plane_from_obj_mesh_2 = Mesh(_2_left_sliding_plane_from_obj_mesh)
# Only one type of geometry
_3_tension_crack_from_one_curve_to_verti_2 = Curve(_3_tension_crack_from_one_curve_to_verti)  # "3: Tension crack from one curve to vertical cutter"
_4_tension_crack_plane_surface_2 = Surface(_4_tension_crack_plane_surface)
_5_tension_crack_from_obj_mesh_2 = Mesh(_5_tension_crack_from_obj_mesh)
_7_right_sliding_plane_from_plane_surfac_2 = Surface(_7_right_sliding_plane_from_plane_surfac)  # "7: Right sliding plane from plane surface"
_8_right_sliding_plane_from_obj_mesh_2 = Mesh(_8_right_sliding_plane_from_obj_mesh)
# Only one type of geometry
_6_right_sliding_plane_from_curves_2 = Curve(_6_right_sliding_plane_from_curves)

# ---- group: Get lower bounding XY plane from cutters' geometry
bounding_rectangle = BoundingRectangle(
    Geometry=flatten([_0_left_sliding_plane_from_curve_s_2, _1_left_sliding_plane_from_surface_2, _2_left_sliding_plane_from_obj_mesh_2, _3_tension_crack_from_one_curve_to_verti_2, _4_tension_crack_plane_surface_2, _5_tension_crack_from_obj_mesh_2, _6_right_sliding_plane_from_curves_2, _7_right_sliding_plane_from_plane_surfac_2, _8_right_sliding_plane_from_obj_mesh_2]),
    Plane=PlaneXY(0, 0, 0),
    Axis=0,
    Slide=0,
    Union=True)  # -> Bounding, DimensionX, DimensionY
lower_bounding_xy_plane = Plane(bounding_rectangle.Bounding)

# ----
# 2. Left sliding plane OBJ MESH to cutter
_2_left_sliding_plane_from_obj_mesh_3 = Mesh(_2_left_sliding_plane_from_obj_mesh_2)
face_normals = FaceNormals(Mesh=_2_left_sliding_plane_from_obj_mesh_3)  # -> Centers, Normals
list_item = ListItem(List=face_normals.Centers, Index="0", Wrap=True)
list_item_2 = ListItem(List=face_normals.Normals, Index="0", Wrap=True)
plane_normal = PlaneNormal(Origin=list_item, ZAxis=list_item_2)  # -> simplify(flatten(Plane))
sliding_plane = Plane(plane_normal)
bounding_rectangle_2 = BoundingRectangle(Geometry=graft(_2_left_sliding_plane_from_obj_mesh_3), Plane=graft(sliding_plane), Axis=0, Slide=0, Union=True)  # -> flatten(Bounding), DimensionX, DimensionY
deconstruct_brep = DeconstructBrep(Brep=bounding_rectangle_2.Bounding)  # -> Faces, Edges, Vertices
graft_tree = GraftTree(Tree=deconstruct_brep.Vertices, IncludeEmptyLists=True, IncludeNullItems=True)
split_tree = SplitTree(Data=graft_tree, Masks=flatten("{?;?;1}"))  # -> Positive, Negative
split_tree_2 = SplitTree(Data=graft_tree, Masks=flatten("{?;?;0}"))  # -> Positive, Negative
split_tree_3 = SplitTree(Data=graft_tree, Masks=flatten("{?;?;2}"))  # -> Positive, Negative
split_tree_4 = SplitTree(Data=graft_tree, Masks=flatten("{?;?;3}"))  # -> Positive, Negative
_4point_surface = _4PointSurface(CornerA=split_tree_2.Positive, CornerB=split_tree.Positive, CornerC=split_tree_3.Positive, CornerD=split_tree_4.Positive)  # -> flatten(Surface)
area = Area(Geometry=_4point_surface)  # -> Area, Centroid
scale = Scale(Geometry=_4point_surface, Center=area.Centroid, Factor=Slider(100, range=0..100))  # -> Geometry, Transform
left_sliding_plane_cutter_from_obj_mesh = Surface(scale.Geometry)

# ----
# 1. Left sliding plane surface to cutter
_1_left_sliding_plane_from_surface_3 = Surface(_1_left_sliding_plane_from_surface_2)
area_2 = Area(Geometry=_1_left_sliding_plane_from_surface_3)  # -> Area, Centroid
scale_2 = Scale(Geometry=_1_left_sliding_plane_from_surface_3, Center=area_2.Centroid, Factor=Slider(100, range=0..100))  # -> Geometry, Transform
left_sliding_plane_cutter_from_plane_sur = Surface(scale_2.Geometry)  # "Left sliding plane cutter from plane surfaces"

# ----
# 5. Tension crack from OBJ MESH to cutter
_5_tension_crack_from_obj_mesh_3 = Mesh(_5_tension_crack_from_obj_mesh_2)
face_normals_2 = FaceNormals(Mesh=_5_tension_crack_from_obj_mesh_3)  # -> Centers, Normals
list_item_3 = ListItem(List=face_normals_2.Centers, Index="0", Wrap=True)
list_item_4 = ListItem(List=face_normals_2.Normals, Index="0", Wrap=True)
plane_normal_2 = PlaneNormal(Origin=list_item_3, ZAxis=list_item_4)  # -> simplify(flatten(Plane))
sliding_plane_2 = Plane(plane_normal_2)
bounding_rectangle_3 = BoundingRectangle(Geometry=graft(_5_tension_crack_from_obj_mesh_3), Plane=graft(sliding_plane_2), Axis=0, Slide=0, Union=True)  # -> flatten(Bounding), DimensionX, DimensionY
deconstruct_brep_2 = DeconstructBrep(Brep=bounding_rectangle_3.Bounding)  # -> Faces, Edges, Vertices
graft_tree_2 = GraftTree(Tree=deconstruct_brep_2.Vertices, IncludeEmptyLists=True, IncludeNullItems=True)
split_tree_5 = SplitTree(Data=graft_tree_2, Masks=flatten("{?;?;1}"))  # -> Positive, Negative
split_tree_6 = SplitTree(Data=graft_tree_2, Masks=flatten("{?;?;0}"))  # -> Positive, Negative
split_tree_7 = SplitTree(Data=graft_tree_2, Masks=flatten("{?;?;2}"))  # -> Positive, Negative
split_tree_8 = SplitTree(Data=graft_tree_2, Masks=flatten("{?;?;3}"))  # -> Positive, Negative
_4point_surface_2 = _4PointSurface(
    CornerA=split_tree_6.Positive,
    CornerB=split_tree_5.Positive,
    CornerC=split_tree_7.Positive,
    CornerD=split_tree_8.Positive)  # -> flatten(Surface)
area_3 = Area(Geometry=_4point_surface_2)  # -> Area, Centroid
scale_3 = Scale(Geometry=_4point_surface_2, Center=area_3.Centroid, Factor=Slider(100, range=0..100))  # -> Geometry, Transform
tension_crack_cutter_from_obj_mesh = Surface(scale_3.Geometry)

# ----
# 4. Tension crack plane surface to cutter
_4_tension_crack_plane_surface_3 = Surface(_4_tension_crack_plane_surface_2)
area_4 = Area(Geometry=_4_tension_crack_plane_surface_3)  # -> Area, Centroid
scale_4 = Scale(Geometry=_4_tension_crack_plane_surface_3, Center=area_4.Centroid, Factor=Slider(100, range=0..100))  # -> Geometry, Transform
tension_crack_cutters_from_plane_surface = Surface(scale_4.Geometry)

# ----
# 3: Vertical tension crack to be defined by a curve
curve_to_vertical_surface = Curve(_3_tension_crack_from_one_curve_to_verti_2)
number_slider = Slider(100, range=0..100)
extend_curve = ExtendCurve(Curve=curve_to_vertical_surface, Type="0", Start=number_slider, End=number_slider)
unit_z = UnitZ(Factor=number_slider)
curve = Curve(extend_curve)
negative = Negative(Value=unit_z)
move = Move(Geometry=curve, Motion=unit_z)  # -> Geometry, Transform
move_2 = Move(Geometry=curve, Motion=negative)  # -> Geometry, Transform
merge = Merge(Data1=move.Geometry, Data2=move_2.Geometry)
loft = Loft(Curves=merge, Options={Adjust=False, Closed=False, LoftEnds=0, LoftSimp=0, LoftType=0, Rebuild=10, Refit=0.01})
tension_crack_cutter_from_curve = Surface(loft)

# ----
# 8.Right sliding plane from OBJ MESH to cutter
_5_tension_crack_from_obj_mesh_4 = Mesh(_8_right_sliding_plane_from_obj_mesh_2)
face_normals_3 = FaceNormals(Mesh=_5_tension_crack_from_obj_mesh_4)  # -> Centers, Normals
list_item_5 = ListItem(List=face_normals_3.Centers, Index="0", Wrap=True)
list_item_6 = ListItem(List=face_normals_3.Normals, Index="0", Wrap=True)
plane_normal_3 = PlaneNormal(Origin=list_item_5, ZAxis=list_item_6)  # -> simplify(flatten(Plane))
sliding_plane_3 = Plane(plane_normal_3)
bounding_rectangle_4 = BoundingRectangle(Geometry=graft(_5_tension_crack_from_obj_mesh_4), Plane=graft(sliding_plane_3), Axis=0, Slide=0, Union=True)  # -> flatten(Bounding), DimensionX, DimensionY
deconstruct_brep_3 = DeconstructBrep(Brep=bounding_rectangle_4.Bounding)  # -> Faces, Edges, Vertices
graft_tree_3 = GraftTree(Tree=deconstruct_brep_3.Vertices, IncludeEmptyLists=True, IncludeNullItems=True)
split_tree_9 = SplitTree(Data=graft_tree_3, Masks=flatten("{?;?;1}"))  # -> Positive, Negative
split_tree_10 = SplitTree(Data=graft_tree_3, Masks=flatten("{?;?;0}"))  # -> Positive, Negative
split_tree_11 = SplitTree(Data=graft_tree_3, Masks=flatten("{?;?;2}"))  # -> Positive, Negative
split_tree_12 = SplitTree(Data=graft_tree_3, Masks=flatten("{?;?;3}"))  # -> Positive, Negative
_4point_surface_3 = _4PointSurface(
    CornerA=split_tree_10.Positive,
    CornerB=split_tree_9.Positive,
    CornerC=split_tree_11.Positive,
    CornerD=split_tree_12.Positive)  # -> flatten(Surface)
area_5 = Area(Geometry=_4point_surface_3)  # -> Area, Centroid
scale_5 = Scale(Geometry=_4point_surface_3, Center=area_5.Centroid, Factor=Slider(100, range=0..100))  # -> Geometry, Transform
other_cutter_s_from_obj_mesh = Surface(scale_5.Geometry)

# ----
# 7. Right sliding plane surface to cutter
_7_other_cutters_from_plane_surface = Surface(_7_right_sliding_plane_from_plane_surfac_2)
area_6 = Area(Geometry=_7_other_cutters_from_plane_surface)  # -> Area, Centroid
scale_6 = Scale(Geometry=_7_other_cutters_from_plane_surface, Center=area_6.Centroid, Factor=Slider(100, range=0..100))  # -> Geometry, Transform
other_cutters_from_plane_surface_s = Surface(scale_6.Geometry)

# ----
# 0-1. Input data Warnings
# Input left sliding plane geometry data warnings
# Input tension crack geometry data warnings
# Input right sliding plane geometry data warnings
null_item = NullItem(Item=_1_left_sliding_plane_from_surface_2)  # -> NullFlags, InvalidFlags, Description
null_item_2 = NullItem(Item=_0_left_sliding_plane_from_curve_s_2)  # -> NullFlags, InvalidFlags, Description
null_item_3 = NullItem(Item=_2_left_sliding_plane_from_obj_mesh_2)  # -> NullFlags, InvalidFlags, Description
null_item_4 = NullItem(Item=_4_tension_crack_plane_surface_2)  # -> NullFlags, InvalidFlags, Description
null_item_5 = NullItem(Item=_3_tension_crack_from_one_curve_to_verti_2)  # -> NullFlags, InvalidFlags, Description
null_item_6 = NullItem(Item=_5_tension_crack_from_obj_mesh_2)  # -> NullFlags, InvalidFlags, Description
null_item_7 = NullItem(Item=_7_right_sliding_plane_from_plane_surfac_2)  # -> NullFlags, InvalidFlags, Description
null_item_8 = NullItem(Item=_6_right_sliding_plane_from_curves_2)  # -> NullFlags, InvalidFlags, Description
null_item_9 = NullItem(Item=_8_right_sliding_plane_from_obj_mesh_2)  # -> NullFlags, InvalidFlags, Description
merge_2 = Merge(Data1=null_item_2.NullFlags, Data2=null_item.NullFlags, Data3=null_item_3.NullFlags)
merge_3 = Merge(Data1=null_item_5.NullFlags, Data2=null_item_4.NullFlags, Data3=null_item_6.NullFlags)
merge_4 = Merge(Data1=null_item_8.NullFlags, Data2=null_item_7.NullFlags, Data3=null_item_9.NullFlags)
invert_boolean = InvertBoolean(Boolean=merge_2)  # -> Inverted, Number
invert_boolean_2 = InvertBoolean(Boolean=merge_3)  # -> Inverted, Number
invert_boolean_3 = InvertBoolean(Boolean=merge_4)  # -> Inverted, Number
mass_addition = MassAddition(Input=invert_boolean.Inverted)  # -> Result, PartialResults
mass_addition_2 = MassAddition(Input=invert_boolean_2.Inverted)  # -> Result, PartialResults
mass_addition_3 = MassAddition(Input=invert_boolean_3.Inverted)  # -> Result, PartialResults
number_of_tension_crack_input_geometries = Integer(mass_addition_2.Result)

text = Text("Select one type of geometry")
text_2 = Text("Select one type of geometry if applicable")
text_3 = Text("OK!")
text_4 = Text("Set only one type of geometry")

stream_filter = StreamFilter(Gate=mass_addition_2.Result, Stream0=text_2, Stream1=text_3, Stream2=text_4, Stream3=text_4)
stream_filter_2 = StreamFilter(Gate=mass_addition.Result, Stream0=text, Stream1=text_3, Stream2=text_4, Stream3=text_4)
stream_filter_3 = StreamFilter(Gate=mass_addition_3.Result, Stream0=text, Stream1=text_3, Stream2=text_4, Stream3=text_4)
tension_crack_geometry = Panel(stream_filter)
sliding_plane_geometry = Panel(stream_filter_2)
sliding_plane_geometry_2 = Panel(stream_filter_3)

number_of_right_sliding_plane_geometry = Panel(sliding_plane_geometry_2)

check_number_of_left_sliding_plane_geome = Text(stream_filter_2)  # "Check: number of left sliding plane geometry"
check_number_of_right_sliding_plane_geom = Text(stream_filter_3)  # "Check: Number of right sliding plane geometry"
check_tension_crack_geometry = Text(stream_filter)
check_number_of_right_sliding_plane_geom_2 = ClusterOutput(check_number_of_right_sliding_plane_geom)  # "Check: Number of right sliding plane geometry"
check_number_of_left_sliding_plane_geome_2 = ClusterOutput(check_number_of_left_sliding_plane_geome)  # "Check: number of left sliding plane geometry"
check_tension_crack_geometry_2 = ClusterOutput(check_tension_crack_geometry)

# ----
# 0: Left sliding plane from curve(s) to one cutter
_0_left_sliding_plane_from_curve_s_3 = Curve(_0_left_sliding_plane_from_curve_s_2)
divide_curve = DivideCurve(Curve=_0_left_sliding_plane_from_curve_s_3, Count=Slider(50, range=0..100), Kinks=False)  # -> Points, Tangents, Parameters

# ----
# Flattened curve points to form only one cutter
plane_fit = PlaneFit(Points=flatten(divide_curve.Points))  # -> Plane, Deviation

bounding_box = BoundingBox(Content=divide_curve.Points, Plane=plane_fit.Plane, UnionBox=True)  # -> Box, Box_2
box_properties = BoxProperties(Box=bounding_box.Box)  # -> Center, Diagonal, Area, Volume, Degeneracy
square_root = SquareRoot(Value=box_properties.Area)
deconstruct_plane = DeconstructPlane(Plane=plane_fit.Plane)  # -> Origin, XAxis, YAxis, ZAxis
move_to_point = MoveToPoint(Geometry=plane_fit.Plane, PointA=deconstruct_plane.Origin, PointB=box_properties.Center)  # -> Moved, Vector, Transform
negative_2 = Negative(Value=square_root)
construct_domain = ConstructDomain(DomainStart=negative_2, DomainEnd=square_root)
plane_surface = PlaneSurface(Plane=move_to_point.Moved, XSize=construct_domain, YSize=construct_domain)
surface = Surface(flatten(plane_surface))
area_7 = Area(Geometry=surface)  # -> Area, Centroid
scale_7 = Scale(Geometry=surface, Center=area_7.Centroid, Factor=Slider(100, range=0..100))  # -> Geometry, Transform
left_sliding_plane_cutter_from_curve_s = Surface(flatten(scale_7.Geometry))

# ----
# 6: Right sliding plane from curve(s) to one cutter
_6_right_sliding_plane_from_curve_s = Curve(_6_right_sliding_plane_from_curves_2)
divide_curve_2 = DivideCurve(Curve=_6_right_sliding_plane_from_curve_s, Count=Slider(50, range=0..100), Kinks=False)  # -> Points, Tangents, Parameters

# ----
# Flattened curve points to form only one cutter
plane_fit_2 = PlaneFit(Points=flatten(divide_curve_2.Points))  # -> Plane, Deviation

bounding_box_2 = BoundingBox(Content=divide_curve_2.Points, Plane=plane_fit_2.Plane, UnionBox=True)  # -> Box, Box_2
box_properties_2 = BoxProperties(Box=bounding_box_2.Box)  # -> Center, Diagonal, Area, Volume, Degeneracy
deconstruct_plane_2 = DeconstructPlane(Plane=plane_fit_2.Plane)  # -> Origin, XAxis, YAxis, ZAxis
move_to_point_2 = MoveToPoint(Geometry=plane_fit_2.Plane, PointA=deconstruct_plane_2.Origin, PointB=box_properties_2.Center)  # -> Moved, Vector, Transform
square_root_2 = SquareRoot(Value=box_properties_2.Area)
negative_3 = Negative(Value=square_root_2)
construct_domain_2 = ConstructDomain(DomainStart=negative_3, DomainEnd=square_root_2)
plane_surface_2 = PlaneSurface(Plane=move_to_point_2.Moved, XSize=construct_domain_2, YSize=construct_domain_2)
surface_2 = Surface(flatten(plane_surface_2))
area_8 = Area(Geometry=surface_2)  # -> Area, Centroid
scale_8 = Scale(Geometry=surface_2, Center=area_8.Centroid, Factor=Slider(100, range=0..100))  # -> Geometry, Transform
other_cutters_from_curve_s = Surface(flatten(scale_8.Geometry))

# ----
# - Box 0 = 5
# - Box 3 is unique since it is set to form a vertical curve by default.
# - Box 1 = 4=7
# - Box 2=5=8
# 1-2. Creating cutter surfaces
merge_5 = Merge(
    Data1=tension_crack_cutter_from_curve,
    Data2=tension_crack_cutters_from_plane_surface,
    Data3=tension_crack_cutter_from_obj_mesh)
merge_6 = Merge(
    Data1=left_sliding_plane_cutter_from_curve_s,
    Data2=left_sliding_plane_cutter_from_plane_sur,
    Data3=left_sliding_plane_cutter_from_obj_mesh)
merge_7 = Merge(Data1=other_cutters_from_curve_s, Data2=other_cutters_from_plane_surface_s, Data3=other_cutter_s_from_obj_mesh)
tension_crack_plane_brep = Brep(merge_5)
right_sliding_plane_brep = Brep(merge_7)
left_sliding_plane_brep = Brep(merge_6)

wedgevolume_cloud_cuttersurface2brep = WedgeVolume_Cloud_CutterSurface2Brep(
    patch_surface=patch_surface_2,
    cloud=point_cloud_2,
    point_in_wedge=point_in_wedge_2,
    leftjointsurface=left_sliding_plane_brep,
    rightjointsurface=right_sliding_plane_brep,
    tensioncracksurface=tension_crack_plane_brep,
    lower_bounding_xy_plane=lower_bounding_xy_plane,
    clip_lower_boundary=clip_lower_boundary_2)  # -> wedge_brep_3, left_joint_trimmed_cutter_brep_2, right_joint_trimmed_cutter_brep_2, tension_crack_trimmed_cutter_brep_2, block_slope_surface_3

# ---- group: Get wedge bottom point
deconstruct_brep_4 = DeconstructBrep(Brep=wedgevolume_cloud_cuttersurface2brep.block_slope_surface_3)  # -> Faces, Edges, Vertices
deconstruct = Deconstruct(Point=deconstruct_brep_4.Vertices)  # -> XComponent, YComponent, ZComponent
sort_list = SortList(Keys=deconstruct.ZComponent, ValuesValuesA=deconstruct_brep_4.Vertices)  # -> Keys, ValuesValuesA
# Consider only the largest surfaces, dependent on number of geometry
# (if tension crack present = 4; if tension crack not present = 3).
first_last = FirstLast(List=sort_list.ValuesValuesA)  # -> FirstValue, LastValue

# ----
brep_2_volume = Brep(wedgevolume_cloud_cuttersurface2brep.wedge_brep_3)
left_joint_trimmed_cutter_brep = Brep(wedgevolume_cloud_cuttersurface2brep.left_joint_trimmed_cutter_brep_2)
right_joint_trimmed_cutter_brep = Brep(wedgevolume_cloud_cuttersurface2brep.right_joint_trimmed_cutter_brep_2)
tension_crack_trimmed_cutter_brep = Brep(wedgevolume_cloud_cuttersurface2brep.tension_crack_trimmed_cutter_brep_2)
block_slope_surface = Surface(wedgevolume_cloud_cuttersurface2brep.block_slope_surface_3)
merge_8 = Merge(Data1=left_sliding_plane_brep, Data2=tension_crack_plane_brep, Data3=right_sliding_plane_brep)  # -> flatten(Result)
wedge_bottom_point = Point(first_last.FirstValue)
cutter_planes_brep = Brep(merge_8)
brep_2_volume_2 = ClusterOutput(brep_2_volume)
left_joint_trimmed_cutter_brep_2 = ClusterOutput(left_joint_trimmed_cutter_brep)
right_joint_trimmed_cutter_brep_2 = ClusterOutput(right_joint_trimmed_cutter_brep)
tension_crack_trimmed_cutter_brep_2 = ClusterOutput(tension_crack_trimmed_cutter_brep)
block_slope_surface_2 = ClusterOutput(block_slope_surface)
wedge_bottom_point_2 = ClusterOutput(wedge_bottom_point)
cutter_planes_brep_2 = ClusterOutput(cutter_planes_brep)

# ----
# 2-1. Calculate volume
brep_2_volume_3 = Brep(brep_2_volume)
volume = Volume(Geometry=brep_2_volume_3)  # -> Volume, Centroid
round_to_decimal_place = RoundToDecimalPlace(NumberX=volume.Volume, DecimalPlace="1", RoundType=0)  # -> Rounded, Difference

# ----
# Step 2: Calculate volume
volume_2 = Panel(volume.Volume)

volume_m3 = Number(round_to_decimal_place.Rounded)
wedge_centroid = Point(volume.Centroid)
volume_m3_2 = ClusterOutput(volume_m3)

wedge_centroid_2 = ClusterOutput(wedge_centroid)

# ==== cluster BakeWedgetoSublayers
wedge_id_integer = ClusterInput()
bake_to_sublayers = ClusterInput()
volume_m3 = ClusterInput()
block_slope_surface = ClusterInput()
block_right_sliding_mesh = ClusterInput()
block_left_sliding_mesh = ClusterInput()
brep_2_volume = ClusterInput()
block_tension_crack_mesh = ClusterInput()
block_right_sliding_brep = ClusterInput()
bake_to_sublayers_2 = Boolean(bake_to_sublayers)
wedge_id_integer_2 = Integer(wedge_id_integer)
block_right_sliding_mesh_2 = Mesh(block_right_sliding_mesh)
block_right_sliding_brep_2 = Brep(block_right_sliding_brep)
block_left_sliding_mesh_2 = Mesh(block_left_sliding_mesh)
volume_m3_2 = Number(volume_m3)
brep_2_volume_2 = Brep(brep_2_volume)
block_tension_crack_mesh_2 = Mesh(block_tension_crack_mesh)

# ---- group: Dip/Dip Direction of joint surfaces
# Dip/Dip Directions
mesh_dip_dipdirection = MeshDipDipDirection(mesh=block_tension_crack_mesh_2)  # -> dip_deg_3, dip_direction_deg_2, dip_dipdirection_2
mesh_dip_dipdirection_2 = MeshDipDipDirection(mesh=block_right_sliding_mesh_2)  # -> dip_deg_3, dip_direction_deg_2, dip_dipdirection_2
mesh_dip_dipdirection_3 = MeshDipDipDirection(mesh=block_left_sliding_mesh_2)  # -> dip_deg_3, dip_direction_deg_2, dip_dipdirection_2
null_item = NullItem(Item=mesh_dip_dipdirection.dip_deg_3)  # -> NullFlags, InvalidFlags, Description
stream_filter = StreamFilter(Gate=null_item.NullFlags, Stream0=mesh_dip_dipdirection.dip_dipdirection_2)

# ----
rightjoint_dip_dipdirection = Text(mesh_dip_dipdirection_2.dip_dipdirection_2)
leftjoint_dip_dipdirection = Text(mesh_dip_dipdirection_3.dip_dipdirection_2)
block_slope_surface_2 = Surface(block_slope_surface)

# ----
# Bake to sublayers
bake_to_layer_wedgeblock_bake = Boolean(bake_to_sublayers_2)
concatenate = Concatenate(FragmentA=volume_m3_2, FragmentB="m3")
panel = Panel("""Solid 
LeftJoint 
RightJoint 
TensionCrack 
SlopeSurface 
SlopeCrestPoint """)
entwine = Entwine(
    Branch00=concatenate,
    Branch01=leftjoint_dip_dipdirection,
    Branch02=rightjoint_dip_dipdirection,
    Branch03=stream_filter,
    FlattenInputs=True)
concatenate_2 = Concatenate(FragmentA="Wedge", FragmentB=wedge_id_integer_2)
concatenate_3 = Concatenate(FragmentA=graft(panel), FragmentB=graft(entwine))  # -> flatten(Result)
concatenate_4 = Concatenate(B="Wedge", Fragment_A=wedge_id_integer_2, Fragment_B="::", A=concatenate_3)
stream_filter_2 = StreamFilter(Gate=bake_to_layer_wedgeblock_bake, Stream1=concatenate_4)
explode_tree = ExplodeTree(Data=graft(concatenate_3))  # -> Branch0, Branch1, Branch2, Branch3, Branch4, Branch5
create_modify_layers = CreateModifyLayers(LayerName=stream_filter_2, DeleteLayer=False, enableFullPath=True)  # -> LayerNames, LayerFullPath
explode_tree_2 = ExplodeTree(Data=graft(create_modify_layers.LayerFullPath))  # -> Branch0, Branch1, Branch2, Branch3, Branch4, Branch5
createattributes = CreateAttributes(Name=explode_tree.Branch3, LayerName=explode_tree_2.Branch2, Color=explode_tree_2.Branch3, enableFullPath=True)
createattributes_2 = CreateAttributes(Name=explode_tree.Branch4, LayerName=explode_tree_2.Branch4, enableFullPath=True)
createattributes_3 = CreateAttributes(Name=explode_tree.Branch0, LayerName=explode_tree_2.Branch0, enableFullPath=True)
createattributes_4 = CreateAttributes(Name=explode_tree.Branch2, LayerName=explode_tree_2.Branch2, enableFullPath=True)
createattributes_5 = CreateAttributes(Name=explode_tree.Branch5, LayerName=explode_tree_2.Branch5, enableFullPath=True)
createattributes_6 = CreateAttributes(Name=explode_tree.Branch1, LayerName=explode_tree_2.Branch1, enableFullPath=True)
bake_geometry = BakeGeometry(
    Bake=bake_to_layer_wedgeblock_bake,
    Geometry=block_tension_crack_mesh_2,
    Attributes=createattributes,
    DeleteOldBakes=False,
    PreserveTrees=False)
bake_geometry_2 = BakeGeometry(
    Bake=bake_to_layer_wedgeblock_bake,
    Geometry=brep_2_volume_2,
    Attributes=createattributes_3,
    DeleteOldBakes=False,
    PreserveTrees=False)
bake_geometry_3 = BakeGeometry(
    Bake=bake_to_layer_wedgeblock_bake,
    Geometry=block_left_sliding_mesh_2,
    Attributes=createattributes_6,
    DeleteOldBakes=False,
    PreserveTrees=False)
bake_geometry_4 = BakeGeometry(
    Bake=bake_to_layer_wedgeblock_bake,
    Geometry=block_right_sliding_mesh_2,
    Attributes=createattributes_4,
    DeleteOldBakes=False,
    PreserveTrees=False)
bake_geometry_5 = BakeGeometry(Bake=bake_to_layer_wedgeblock_bake, Attributes=createattributes_5, DeleteOldBakes=False, PreserveTrees=False)
bake_geometry_6 = BakeGeometry(
    Bake=bake_to_layer_wedgeblock_bake,
    Geometry=block_slope_surface_2,
    Attributes=createattributes_2,
    DeleteOldBakes=False,
    PreserveTrees=False)

# ==== cluster WriteToSWedge
scale_wedge_with_volume = ClusterInput()
write_to_excel_template = ClusterInput()
file_path = ClusterInput()
wedgeid = ClusterInput()
file_path_2 = FilePath(file_path)
write_to_excel_template_2 = Boolean(write_to_excel_template)
wedgeid_2 = Integer(wedgeid)
scale_wedge_with_volume_2 = Boolean(scale_wedge_with_volume)
addition = Addition(A=wedgeid_2, B="5")

# ----
# SLOPE
tension_crack_dipdirection = ClusterInput()
upper_face_dip_direction = ClusterInput()
tension_crack_dip = ClusterInput()
rock_unit_weight = ClusterInput()
upper_face_dip = ClusterInput()
slope_dip = ClusterInput()
slope_dip_direction = ClusterInput()
wedge_height = ClusterInput()
tension_crack_dip_2 = Data(tension_crack_dip)
tension_crack_dipdirection_2 = Data(tension_crack_dipdirection)
column_start_position = Panel("1")
null_values = NullValues(LastSaveLocalization="neutral,N")  # -> Null, NaN, Infinity, Infinity_2
wedge_height_2 = Data(wedge_height)
upper_face_dip_direction_2 = Data(upper_face_dip_direction)
upper_face_dip_2 = Data(upper_face_dip)
slope_dip_direction_2 = Data(slope_dip_direction)
excel_worksheet = Panel("2")
slope_dip_2 = Data(slope_dip)
rock_unit_weight_2 = Number(rock_unit_weight)
concatenate = Concatenate(FragmentA="Wedge", FragmentB=wedgeid_2)
# TO find the solution for writing to several worksheet!
entwine = Entwine(
    Branch00=concatenate,
    Branch01=slope_dip_2,
    Branch02=slope_dip_direction_2,
    Branch03=wedge_height_2,
    Branch04=null_values.Null,
    Branch05=upper_face_dip_2,
    Branch06=upper_face_dip_direction_2,
    Branch07=null_values.Null,
    Branch08=tension_crack_dip_2,
    Branch09=tension_crack_dipdirection_2,
    Branch010=null_values.Null,
    Branch011=rock_unit_weight_2,
    FlattenInputs=True)  # -> flatten(Result)
true_rows = BooleanToggle(True)
write_options = WriteOptions(
    FilePath=file_path_2,
    ClearDataOverwrite=Toggle(False),
    SaveAfterWrite=Toggle(True),
    CloseAfterWrite=Toggle(False),
    ColumnStartPosition=column_start_position,
    RowStartPosition=addition)  # -> UserMessages, WriteOptions
write_to_excel = WriteToExcel(
    Run=write_to_excel_template_2,
    ExcelWorksheet=excel_worksheet,
    WriteOptions=write_options.WriteOptions,
    ColumnnsOrRows=true_rows,
    DataToWriteIntoColumns=entwine)

# ----
# SCALE WEDGE
volume = ClusterInput()
null_values_2 = NullValues(LastSaveLocalization="neutral,N")  # -> Null, NaN, Infinity, Infinity_2
excel_worksheet_2 = Panel("7")
volume_2 = Data(volume)
null_values_3 = NullValues(LastSaveLocalization="neutral,N")  # -> Null, NaN, Infinity, Infinity_2
stream_filter = StreamFilter(Gate=scale_wedge_with_volume_2, Stream0=null_values_2.Null, Stream1=volume_2)
entwine_2 = Entwine(
    Branch00=concatenate,
    Branch01=null_values_3.Null,
    Branch02=null_values_3.Null,
    Branch03=null_values_3.Null,
    Branch04=null_values_3.Null,
    Branch05=null_values_3.Null,
    Branch06=null_values_3.Null,
    Branch07=null_values_3.Null,
    Branch08=null_values_3.Null,
    Branch09=stream_filter,
    FlattenInputs=True)  # -> flatten(Result)
write_to_excel_2 = WriteToExcel(
    Run=write_to_excel_template_2,
    ExcelWorksheet=excel_worksheet_2,
    WriteOptions=write_options.WriteOptions,
    ColumnnsOrRows=true_rows,
    DataToWriteIntoColumns=entwine_2)

# ----
# JOINTS
joint2_dip_direction = ClusterInput()
joint2_dip = ClusterInput()
excel_worksheet_3 = Panel("3")
joint_1_phi = ClusterInput()
joint1_dip_direction = ClusterInput()
joint1_dip = ClusterInput()
joint_2_phi = ClusterInput()
joint_1_phi_2 = Number(joint_1_phi)
joint_2_phi_2 = Number(joint_2_phi)
joint1_dip_direction_2 = Data(joint1_dip_direction)
joint2_dip_2 = Data(joint2_dip)
joint2_dip_direction_2 = Data(joint2_dip_direction)
null_values_4 = NullValues(LastSaveLocalization="neutral,N")  # -> Null, NaN, Infinity, Infinity_2
joint1_dip_2 = Data(joint1_dip)
entwine_3 = Entwine(
    Branch00=concatenate,
    Branch01=joint1_dip_2,
    Branch02=joint1_dip_direction_2,
    Branch03="0",
    Branch04="0",
    Branch05=joint_1_phi_2,
    Branch06=null_values_4.Null,
    Branch07=null_values_4.Null,
    Branch08=null_values_4.Null,
    Branch09=null_values_4.Null,
    Branch010=null_values_4.Null,
    Branch011=null_values_4.Null,
    Branch012=null_values_4.Null,
    Branch013=joint2_dip_2,
    Branch014=joint2_dip_direction_2,
    Branch015="0",
    Branch016="0",
    Branch017=joint_2_phi_2,
    FlattenInputs=True)  # -> flatten(Result)
write_to_excel_3 = WriteToExcel(
    Run=write_to_excel_template_2,
    ExcelWorksheet=excel_worksheet_3,
    WriteOptions=write_options.WriteOptions,
    ColumnnsOrRows=true_rows,
    DataToWriteIntoColumns=entwine_3)

# ==== cluster MeshDipDipDirection_2: Calculate dip and direction of mesh

# ---- group: Inputs
mesh = ClusterInput()
round_to_nearest = ClusterInput()
no_of_decimal_place = ClusterInput()
round_to_nearest_2 = Boolean(round_to_nearest)
no_of_decimal_place_2 = Integer(no_of_decimal_place)
mesh_2 = Mesh(mesh)

# ---- group: Get arithmetic mean of normal for each mesh
face_normals = FaceNormals(Mesh=mesh_2)  # -> Centers, Normals
average = Average(Input=face_normals.Normals)  # -> flatten(ArithmeticMean)

# ---- group: Obtain horisontal components; ensure vector length greater than zero
deconstruct_vector = DeconstructVector(Vector=average)  # -> XComponent, YComponent, ZComponent
vector_xyz = VectorXYZ(XComponent=deconstruct_vector.XComponent, YComponent=deconstruct_vector.YComponent, ZComponent=0)  # -> Vector, Length
vector_length = VectorLength(Vector=vector_xyz.Vector)
dup = DuplicateDataMatch(SourceDataTree=vector_xyz.Vector, SecondaryDataSecondaryData1="{0,1,0}")  # -> SourceData, SecondaryDataSecondaryData1
equality = Equality(FirstNumber=vector_length, SecondNumber="0")  # -> Equality, Inequality
pick_n_choose = PickNChoose(Pattern=equality.Equality, Stream0=vector_xyz.Vector, Stream1=<missing>)

# ---- group: Dip direction calculation
larger_than = LargerThan(FirstNumber=deconstruct_vector.ZComponent, SecondNumber="0")  # -> LargerThan, OrEqualTo
reverse = Reverse(Vector=pick_n_choose)
pick_n_choose_2 = PickNChoose(Pattern=larger_than.LargerThan, Stream0=reverse, Stream1=pick_n_choose)
unit_y = UnitY(Factor=1)
deconstruct_vector_2 = DeconstructVector(Vector=pick_n_choose_2)  # -> XComponent, YComponent, ZComponent
larger_than_2 = LargerThan(FirstNumber=deconstruct_vector_2.XComponent, SecondNumber="0")  # -> LargerThan, OrEqualTo
angle = Angle(VectorA=unit_y, VectorB=pick_n_choose_2)  # -> Angle, Reflex
pick_n_choose_3 = PickNChoose(Pattern=larger_than_2.LargerThan, Stream0=angle.Reflex, Stream1=angle.Angle)
degrees = Degrees(Radians=pick_n_choose_3)
addition = Addition(A=degrees)

# ---- group: Dip angle calculation
angle_2 = Angle(VectorA=pick_n_choose, VectorB=average)  # -> Angle, Reflex
degrees_2 = Degrees(Radians=angle_2.Angle)
subtraction = Subtraction(A="90", B=degrees_2)
absolute = Absolute(Value=subtraction)

# ---- group: Dip: Replace with null if null; rounding
null_item = NullItem(Item=degrees_2)  # -> NullFlags, InvalidFlags, Description
round_to_decimal_place = RoundToDecimalPlace(NumberX=absolute, DecimalPlace=no_of_decimal_place_2, RoundType=0)  # -> Rounded, Difference
list_indices = ListIndices(List=null_item.NullFlags)
cull_pattern = CullPattern(List=list_indices, CullPattern=null_item.NullFlags)
replace_items = ReplaceItems(List=absolute, Indices=cull_pattern, Wrap=False)
replace_items_2 = ReplaceItems(List=round_to_decimal_place.Rounded, Indices=cull_pattern, Wrap=False)
stream_filter = StreamFilter(Gate=round_to_nearest_2, Stream0=replace_items, Stream1=replace_items_2)

# ---- group: Dip Direction: Replace with null if null; rounding
null_item_2 = NullItem(Item=degrees_2)  # -> NullFlags, InvalidFlags, Description
round_to_decimal_place_2 = RoundToDecimalPlace(NumberX=addition, DecimalPlace=no_of_decimal_place_2, RoundType=0)  # -> Rounded, Difference
list_indices_2 = ListIndices(List=null_item_2.NullFlags)
cull_pattern_2 = CullPattern(List=list_indices_2, CullPattern=null_item_2.NullFlags)
replace_items_3 = ReplaceItems(List=round_to_decimal_place_2.Rounded, Indices=cull_pattern_2, Wrap=False)
replace_items_4 = ReplaceItems(List=degrees, Indices=cull_pattern_2, Wrap=False)
stream_filter_2 = StreamFilter(Gate=round_to_nearest_2, Stream0=replace_items_4, Stream1=replace_items_3)

# ---- group: Output-numeric
dip_deg = Number(stream_filter)
dip_direction_deg = Number(stream_filter_2)
dip_deg_2 = ClusterOutput(dip_deg)
dip_direction_deg_2 = ClusterOutput(dip_direction_deg)

# ---- group: Output-text
concatenate = Concatenate(Fragment_A=dip_deg, A="/", Fragment_B=dip_direction_deg)
dip_dipdirection = Text(concatenate)
dip_dipdirection_2 = ClusterOutput(dip_dipdirection)

# ==== cluster SwedgeModelAndGeometries

left_joint_trimmed_cutter_brep = ClusterInput()
swedge_bottom_point_adjustment_m = ClusterInput()
fit_top_face_bench_width_to_model = ClusterInput()
right_joint_trimmed_cutter_brep = ClusterInput()
crest_left_control_point = ClusterInput()
crest_right_control_point = ClusterInput()
inner_bench_height = ClusterInput()
left_joint_trimmed_cutter_brep_2 = Brep(left_joint_trimmed_cutter_brep)
right_joint_trimmed_cutter_brep_2 = Brep(right_joint_trimmed_cutter_brep)
crest_right_control_point_2 = Point(crest_right_control_point)
crest_left_control_point_2 = Point(crest_left_control_point)
fit_top_face_bench_width_to_model_2 = Boolean(fit_top_face_bench_width_to_model)
swedge_bottom_point_adjustment_m_2 = Number(swedge_bottom_point_adjustment_m)
inner_bench_height_2 = Number(inner_bench_height)

# ---- group: Left Joint round to integer
mesh_dip_dipdirection = MeshDipDipDirection_2(mesh=left_joint_trimmed_cutter_brep_2, round_to_nearest=True, no_of_decimal_place=0)  # -> dip_deg_2, dip_direction_deg_2, dip_dipdirection_2
area = Area(Geometry=left_joint_trimmed_cutter_brep_2)  # -> Area, Centroid
dip_dipdirection_to_plane = DipDipDirectionToPlane(
    dip_deg=mesh_dip_dipdirection.dip_deg_2,
    dip_direction_deg=mesh_dip_dipdirection.dip_direction_deg_2,
    origin=area.Centroid)  # -> plane_2, plane_normal_2

# ----
area_2 = Area(Geometry=right_joint_trimmed_cutter_brep_2)  # -> Area, Centroid

# ---- group: Creating Swedge model / Right Joint round to integer
mesh_dip_dipdirection_2 = MeshDipDipDirection_2(mesh=right_joint_trimmed_cutter_brep_2, round_to_nearest=True, no_of_decimal_place=0)  # -> dip_deg_2, dip_direction_deg_2, dip_dipdirection_2
dip_dipdirection_to_plane_2 = DipDipDirectionToPlane(
    dip_deg=mesh_dip_dipdirection_2.dip_deg_2,
    dip_direction_deg=mesh_dip_dipdirection_2.dip_direction_deg_2,
    origin=area_2.Centroid)  # -> plane_2, plane_normal_2

# ---- group: Creating Swedge model
line = Line(StartPoint=crest_left_control_point_2, EndPoint=crest_right_control_point_2)
extend_curve = ExtendCurve(Curve=line, Type=0, Start="100", End="100")
end_points = EndPoints(Curve=extend_curve)  # -> Start, End
line_2 = Line(StartPoint=end_points.Start, EndPoint=end_points.End)
line_plane = LinePlane(Line=line_2, Plane=dip_dipdirection_to_plane.plane_2)  # -> Point, ParamL, ParamP
line_plane_2 = LinePlane(Line=line_2, Plane=dip_dipdirection_to_plane_2.plane_2)  # -> Point, ParamL, ParamP

# ---- group: Creating Swedge model / Move point along line of intersection - base on inner bench height
brep_brep = BrepBrep(BrepA=left_joint_trimmed_cutter_brep_2, BrepB=right_joint_trimmed_cutter_brep_2)  # -> Curves, Points
join_curves = JoinCurves(Curves=brep_brep.Curves, Preserve=False)
unit_z = UnitZ(Factor=inner_bench_height_2)

# ----
curve_middle = CurveMiddle(Curve=brep_brep.Curves)

# ---- group: Creating Swedge model / Move point along line of intersection - base on inner bench height (continued)
line_sdl = LineSDL(Start=curve_middle, Direction=Vector(0, 0, 1), Length=1)
flip_curve = FlipCurve(Curve=join_curves, Guide=line_sdl)  # -> Curve, Flag
end_points_2 = EndPoints(Curve=flip_curve.Curve)  # -> Start, End
line_3 = Line(StartPoint=end_points_2.Start, EndPoint=end_points_2.End)

# ---- group: Adjust SWedge bottom point
extend_curve_2 = ExtendCurve(Curve=line_3, Type=0, Start=swedge_bottom_point_adjustment_m_2, End="0")
end_points_3 = EndPoints(Curve=extend_curve_2)  # -> Start, End
swedge_bottom_point = Point(end_points_3.Start)

# ---- group: Creating Swedge model / Move point along line of intersection - base on inner bench height (continued)
xy_plane = XYPlane(Origin=swedge_bottom_point)
move = Move(Geometry=xy_plane, Motion=unit_z)  # -> Geometry, Transform
line_plane_3 = LinePlane(Line=line_3, Plane=move.Geometry)  # -> Point, ParamL, ParamP

# ---- group: Creating Swedge model / Move point along line of intersection - base on inner bench height / Pick Upper Face Width end point
pick_n_choose = PickNChoose(Pattern=fit_top_face_bench_width_to_model_2, Stream0=line_plane_3.Point, Stream1=end_points_2.End)
upper_face_width_end_point = Point(pick_n_choose)

# ---- group: Creating Swedge model (continued)
construct_swedge_model = ConstructSwedgeModel(
    upper_face_width_end_point=upper_face_width_end_point,
    left_slope_crest_point=line_plane.Point,
    right_slope_crest_point=line_plane_2.Point,
    swedge_bottom_point=swedge_bottom_point)  # -> swedge_model_mesh_2, upper_face_mesh_2, slope_face_mesh_2, left_joint_face_mesh_2, right_joint_face_mesh_2
volume = Volume(Geometry=construct_swedge_model.swedge_model_mesh_2)  # -> flatten(Volume), Centroid
panel = Panel(volume.Volume)
simulated_swedge_wedge_mesh = Mesh(construct_swedge_model.swedge_model_mesh_2)

# ---- group: Construct Wedge Height Line
swedge_bottom_point_2 = Point(swedge_bottom_point)
crest_left_point = Point(line_plane.Point)
deconstruct = Deconstruct(Point=crest_left_point)  # -> XComponent, YComponent, ZComponent
deconstruct_2 = Deconstruct(Point=swedge_bottom_point_2)  # -> XComponent, YComponent, ZComponent
construct_point = ConstructPoint(XCoordinate=deconstruct_2.XComponent, YCoordinate=deconstruct_2.YComponent, ZCoordinate=deconstruct.ZComponent)
line_4 = Line(StartPoint=swedge_bottom_point_2, EndPoint=construct_point)

# ---- group: Calculate Wedge Height
deconstruct_3 = Deconstruct(Point=upper_face_width_end_point)  # -> XComponent, YComponent, ZComponent
deconstruct_4 = Deconstruct(Point=swedge_bottom_point)  # -> XComponent, YComponent, ZComponent
subtraction = Subtraction(A=deconstruct_3.ZComponent, B=deconstruct_4.ZComponent)

# ----
length = Length(Curve=line_4)

right_joint_face_mesh = Mesh(construct_swedge_model.right_joint_face_mesh_2)
upper_face_mesh = Mesh(construct_swedge_model.upper_face_mesh_2)
left_joint_face_mesh = Mesh(construct_swedge_model.left_joint_face_mesh_2)
slope_face_mesh = Mesh(construct_swedge_model.slope_face_mesh_2)
swedge_model_mesh = ClusterOutput(construct_swedge_model.swedge_model_mesh_2)
upper_face_mesh_2 = ClusterOutput(upper_face_mesh)
right_joint_face_mesh_2 = ClusterOutput(right_joint_face_mesh)
slope_face_mesh_2 = ClusterOutput(slope_face_mesh)
left_joint_face_mesh_2 = ClusterOutput(left_joint_face_mesh)

wedge_height_line = Line(line_4)
inner_bench_height_m = Number(subtraction)
wedge_height_m = Number(length)
inner_bench_height_m_2 = ClusterOutput(inner_bench_height_m)

wedge_height_line_2 = ClusterOutput(wedge_height_line)
wedge_height_m_2 = ClusterOutput(wedge_height_m)

# ==== cluster FilterBoltsByNumber
wedge_centroid = ClusterInput()
available_bolt_lines = ClusterInput()
swedge_slope_face_mesh = ClusterInput()
number_of_bolts_each_length = ClusterInput()

wedge_centroid_2 = Point(wedge_centroid)
available_bolt_lines_2 = Line(available_bolt_lines)
swedge_slope_face_mesh_2 = Mesh(swedge_slope_face_mesh)
number_of_bolts_each_length_2 = Integer(number_of_bolts_each_length)

# ---- group: Plane parallel to Slope surface
face_normals = FaceNormals(Mesh=swedge_slope_face_mesh_2)  # -> Centers, unitize(Normals)
plane_normal = PlaneNormal(Origin=face_normals.Centers, ZAxis=face_normals.Normals)

# ----
pull_point = PullPoint(Point=wedge_centroid_2, Geometry=available_bolt_lines_2, ClosestOnly=False)  # -> ClosestPoint, simplify(Distance)
sort_list = SortList(Keys=pull_point.Distance, ValuesValuesA=available_bolt_lines_2)  # -> Keys, ValuesValuesA
split_list = SplitList(List=sort_list.ValuesValuesA, Index=number_of_bolts_each_length_2)  # -> ListA, ListB
end_points = EndPoints(Curve=split_list.ListA)  # -> Start, End
plane_origin = PlaneOrigin(Base=plane_normal, Origin=end_points.Start)
panel = Panel("""12
3
4
5""")
polygon = Polygon(Plane=plane_origin, Radius="0.1", Segments=simplify(graft(panel)), FilletRadius=0)  # -> Polygon, Length
bolt_lines = Line(simplify(split_list.ListA))
bolt_plates = Brep(simplify(polygon.Polygon))

bolt_lines_2 = ClusterOutput(bolt_lines)
bolt_plates_2 = ClusterOutput(bolt_plates)

# ==== cluster BoltRotation
base = ClusterInput()

# ---- group: Rotating bolt around slope normal
bolt_plunge_rotation_deg = ClusterInput()
bolt_trend_rotation_deg = ClusterInput()
slope_face_dip_direction_deg = ClusterInput()
slope_face_dip_deg = ClusterInput()
slope_face_dip_direction_deg_2 = Integer(slope_face_dip_direction_deg)
slope_face_dip_deg_2 = Integer(slope_face_dip_deg)
base_2 = Point(base)
dip_dipdirection_to_plane = DipDipDirectionToPlane(dip_deg=slope_face_dip_deg_2, dip_direction_deg=slope_face_dip_direction_deg_2, origin=base_2)  # -> plane_2, flatten(plane_normal_2)
reverse = Reverse(Vector=dip_dipdirection_to_plane.plane_normal_2)
deconstruct_plane = DeconstructPlane(Plane=dip_dipdirection_to_plane.plane_2)  # -> Origin, XAxis, YAxis, ZAxis

# ----
bolt_plunge_rotation_deg_2 = Number(bolt_plunge_rotation_deg)
bolt_trend_rotation_deg_2 = Number(bolt_trend_rotation_deg)

# ---- group: Rotating bolt around slope normal / 1. Bolt Plunge
panel = Panel("1")
line_sdl = LineSDL(Start=deconstruct_plane.Origin, Direction=deconstruct_plane.XAxis, Length=panel)
radians = Radians(Degrees=bolt_plunge_rotation_deg_2)
line_sdl_2 = LineSDL(Start=deconstruct_plane.Origin, Direction=reverse, Length=panel)
rotate_axis = RotateAxis(Geometry=line_sdl_2, Angle=radians, Axis=line_sdl)  # -> Geometry, Transform

# ---- group: Rotating bolt around slope normal / 2. Bolt trend
radians_2 = Radians(Degrees=bolt_trend_rotation_deg_2)
line_sdl_3 = LineSDL(Start=deconstruct_plane.Origin, Direction=deconstruct_plane.YAxis, Length=panel)
rotate_axis_2 = RotateAxis(Geometry=rotate_axis.Geometry, Angle=radians_2, Axis=line_sdl_3)  # -> Geometry, Transform

# ---- group: Rotating bolt around slope normal (continued)
entwine = Entwine(Branch00=bolt_plunge_rotation_deg_2, Branch01=bolt_trend_rotation_deg_2, FlattenInputs=True)
cluster = Cluster(vector=rotate_axis_2.Geometry)  # -> trend_2, plunge_2
trend = Panel(cluster.trend_2)
plunge = Panel(cluster.plunge_2)
bolt_direction = Vector(rotate_axis_2.Geometry)
bolt_direction_2 = ClusterOutput(bolt_direction)
plunge_2 = ClusterOutput(cluster.plunge_2)
trend_2 = ClusterOutput(cluster.trend_2)

# ==== cluster FishToCSV
fish = ClusterInput()
fish_2 = Fish(fish)

# ---- group: Constructing CSV Headers / Separating Fish text into items
text_split = TextSplit(Text=fish_2, Separators="\"")
tree_branch = TreeBranch(Tree=simplify(text_split), Path="0", MaintainPaths=True)

# ---- group: Constructing CSV values / Separating each line into items
panel = Panel(""" 
:""")

# ---- group: Constructing CSV values
deconstruct_fish = DeconstructFish(Fishes=fish_2)  # -> Variables, Objectives, flatten(Attributes)
# ---- group: Constructing CSV values / Separating each line into items (continued)
text_split_2 = TextSplit(Text=deconstruct_fish.Attributes, Separators=panel)

# ---- group: Constructing CSV values / Trial ID
list_item = ListItem(List=deconstruct_fish.Variables, Index=0, Wrap=True)  # -> flatten(Item)
list_indices = ListIndices(List=list_item)

# ---- group: Constructing CSV values / Variable results
flip_matrix = FlipMatrix(Data=deconstruct_fish.Variables)
explode_tree = ExplodeTree(Data=flip_matrix)  # -> Branch0, Branch1, Branch2, Branch3, Branch4, Branch5, Branch6, Branch7

# ---- group: Constructing CSV Headers / Getting Variable names
tree_statistics = TreeStatistics(Tree=flip_matrix)  # -> Paths, Length, Count
panel_2 = Panel("2")
series = Series(Start="1", Step=panel_2, Count=tree_statistics.Count)
list_item_2 = ListItem(List=tree_branch, Index=series, Wrap=True)
concatenate = Concatenate(FragmentA="Var_", FragmentB=list_item_2)  # -> flatten(Result)

# ---- group: Constructing CSV values / Objective results
flip_matrix_2 = FlipMatrix(Data=deconstruct_fish.Objectives)
explode_tree_2 = ExplodeTree(Data=flip_matrix_2)  # -> Branch0, Branch1, Branch2

# ---- group: Constructing CSV Headers / Getting Objective names
panel_3 = Panel("1")
tree_statistics_2 = TreeStatistics(Tree=flip_matrix_2)  # -> Paths, Length, Count
first_last = FirstLast(List=series)  # -> FirstValue, LastValue
addition = Addition(A=first_last.LastValue, B=panel_2)
series_2 = Series(Start=addition, Step=panel_2, Count=tree_statistics_2.Count)
list_item_3 = ListItem(List=tree_branch, Index=series_2, Wrap=True)
concatenate_2 = Concatenate(FragmentA="Obj_", FragmentB=list_item_3)  # -> flatten(Result)

# ---- group: Constructing CSV values / Getting Attribtue values
tree_branch_2 = TreeBranch(Tree=simplify(text_split_2), Path="0", MaintainPaths=True)
list_indices_2 = ListIndices(List=tree_branch_2)

# ---- group: Constructing CSV values / Getting Attribtue values / Returns True if item is a number
equality = Equality(FirstNumber=tree_branch_2, SecondNumber=tree_branch_2)  # -> Equality, Inequality

# ---- group: Constructing CSV values / Getting Attribtue values (continued)
cull_pattern = CullPattern(List=list_indices_2, CullPattern=equality.Equality)
list_item_4 = ListItem(List=text_split_2, Index=cull_pattern, Wrap=True)
text_trim = TextTrim(Text=list_item_4, Start=True, End=True)

# ---- group: Constructing CSV Headers / Getting Attribute Headers
subtraction = Subtraction(A=cull_pattern, B="2")
list_item_5 = ListItem(List=text_split_2, Index=subtraction, Wrap=True)
replace_text = ReplaceText(Text=list_item_5, Find=":", RecursiveReplace=False)
concatenate_3 = Concatenate(FragmentA=graft("Attr_"), FragmentB=replace_text)
tree_branch_3 = TreeBranch(Tree=simplify(concatenate_3), Path="0", MaintainPaths=True)  # -> flatten(Branch)

# ---- group: Constructing CSV values / Attribute results
flip_matrix_3 = FlipMatrix(Data=text_trim)
explode_tree_3 = ExplodeTree(Data=flip_matrix_3)  # -> Branch0, Branch1, Branch2, Branch3, Branch4, Branch5, Branch6, Branch7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

# ---- group: Constructing CSV values (continued)
entwine = Entwine(
    Branch00=list_indices,
    Branch01=explode_tree_2.Branch0,
    Branch02=explode_tree_2.Branch1,
    Branch03=explode_tree_2.Branch2,
    Branch04=explode_tree.Branch0,
    Branch05=explode_tree.Branch1,
    Branch06=explode_tree.Branch2,
    Branch07=explode_tree.Branch3,
    Branch08=explode_tree.Branch4,
    Branch09=explode_tree.Branch5,
    Branch010=explode_tree.Branch6,
    Branch011=explode_tree.Branch7,
    Branch012=explode_tree_3.Branch0,
    Branch013=explode_tree_3.Branch1,
    Branch014=explode_tree_3.Branch2,
    Branch015=explode_tree_3.Branch3,
    Branch016=explode_tree_3.Branch4,
    Branch017=explode_tree_3.Branch5,
    Branch018=explode_tree_3.Branch6,
    Branch019=explode_tree_3.Branch7,
    Branch020=explode_tree_3.Branch8,
    Branch021=explode_tree_3.Branch9,
    Branch022=explode_tree_3.Branch10,
    FlattenInputs=True)

# ---- group: Constructing CSV Headers
merge = Merge(Data1="Trial_ID", Data2=concatenate_2, Data3=concatenate, Data4=tree_branch_3)
csv_headers = Panel(merge)

# ----
create_csv = CreateCSV(DataGridHeaders=merge, ValueTree=entwine, Delimiter=",")
csv_string = Data(create_csv)
csv_string_2 = ClusterOutput(csv_string)

# ==== cluster UpdateCSVFieWithParetoBooleans
fish_paretosolutions = ClusterInput()
csv_file_path = ClusterInput()
update_csv_with_pareto_booleans = ClusterInput()
csv_file_path_2 = FilePath(csv_file_path)
fish_paretosolutions_2 = Fish(fish_paretosolutions)
update_csv_with_pareto_booleans_2 = Boolean(update_csv_with_pareto_booleans)
read_file = ReadFile(File=csv_file_path_2, PerLineParse=True)

# ---- group: Getting Pareto Solution Trial ID
text_split = TextSplit(Text=fish_paretosolutions_2, Separators=":")  # -> flatten(Result)
match_text = MatchText(Text=text_split, Pattern="Model Number", Case=True)
list_indices = ListIndices(List=text_split)
mass_addition = MassAddition(Input=match_text)  # -> Result, PartialResults
cull_pattern = CullPattern(List=list_indices, CullPattern=match_text)
addition = Addition(A=cull_pattern, B="1")

# ---- group: New column data
list_length = ListLength(List=read_file)
repeat_data = RepeatData(Data=",0", Length=list_length)

# ---- group: Column Header
replace_items = ReplaceItems(List=repeat_data, Item=",IsParetoSolution", Indices="0", Wrap=False)

# ---- group: Replace column with Pareto Booleans
list_item = ListItem(List=text_split, Index=addition, Wrap=True)
addition_2 = Addition(A=list_item, B="1")
replace_items_2 = ReplaceItems(List=replace_items, Item=",1", Indices=addition_2, Wrap=False)

# ---- group: Update CSV Strings
concatenate = Concatenate(FragmentA=read_file, FragmentB=replace_items_2)
c_write_to_csv = CSharpScript(save=update_csv_with_pareto_booleans_2, path=csv_file_path_2, data=concatenate)  # inputs save: Boolean, path: String, data: list of String
# ---------- c_write_to_csv: C# ----------
    if(save){
      var fileinfo = new System.IO.FileInfo(path);
      if(!fileinfo.Directory.Exists){
        fileinfo.Directory.Create();
      }
      
      var sw = fileinfo.CreateText();
      for(int i = 0; i < data.Count; i++){
        string row = data[i];
        if(i < data.Count - 1){
          sw.WriteLine(row);
        }else{
          sw.Write(row);
        }
      }
      
      sw.Flush();
      sw.Close();
    }
# ---------- end c_write_to_csv ----------

# ==== cluster AvailableBoltPointsAndLines: Find available bolt points bolt lines grouped by bolt lengths based on minimum bolt spacing and bolt direction.

bolting_point_minimum_spacing_m = ClusterInput()
swedge_model_slope_face_mesh = ClusterInput()
edge_clearance_m = ClusterInput()
points_subparallel_with_swedge_slope_fac = ClusterInput()  # "Points Subparallel with SWedge Slope FAce"
block_slope_face = ClusterInput()
swedge_model_centroid = ClusterInput()
edge_clearance_m_2 = Number(edge_clearance_m)
swedge_model_slope_face_mesh_2 = Mesh(swedge_model_slope_face_mesh)
points_subparallel_with_swedge_slope_fac_2 = Point(points_subparallel_with_swedge_slope_fac)  # "Points Subparallel with SWedge Slope FAce"
block_slope_face_2 = Brep(block_slope_face)
bolting_point_minimum_spacing_m_2 = Number(bolting_point_minimum_spacing_m)
swedge_model_centroid_2 = Point(swedge_model_centroid)

# ---- group: Orientation Swedge slope Face plane with XY
# X-direction = horizontal
face_normals = FaceNormals(Mesh=swedge_model_slope_face_mesh_2)  # -> Centers, Normals
plane_normal = PlaneNormal(Origin=face_normals.Centers, ZAxis=face_normals.Normals)
xy_plane = XYPlane(Origin=face_normals.Centers)
plane_plane = PlanePlane(PlaneA=xy_plane, PlaneB=plane_normal)
unit_z = UnitZ(Factor=1)
construct_plane = ConstructPlane(Origin=face_normals.Centers, XAxis=plane_plane, YAxis=unit_z)
swedge_slope_plane_with_xy = Plane(construct_plane)

# ----
bolting_point_minimum_spacing_m_3 = Number(bolting_point_minimum_spacing_m_2)

# ---- group: Construct cloud grid covering the bounding rectangle
bounding_rectangle = BoundingRectangle(Geometry=points_subparallel_with_swedge_slope_fac_2, Plane=swedge_slope_plane_with_xy, Axis=0, Slide=0, Union=True)  # -> Bounding, DimensionX, DimensionY
entwine = Entwine(Branch00=bounding_rectangle.DimensionX, Branch01=bounding_rectangle.DimensionY, FlattenInputs=True)
expression = Expression(Dimension=entwine, spacing=bolting_point_minimum_spacing_m_3, Expression="Dimension/spacing")
parameter_plane_in_rectangle = ParameterPlaneInRectangle(Rectangle=bounding_rectangle.Bounding, ParameterX="0", ParameterY="0")  # -> Plane, Normal
round = Round(Number=expression)  # -> Nearest, Floor, Ceiling
explode_tree = ExplodeTree(Data=round.Ceiling)  # -> Branch0, Branch1
cloud_grid = CloudGrid(
    Plane=parameter_plane_in_rectangle.Plane,
    Size=bolting_point_minimum_spacing_m_3,
    ExtentX=explode_tree.Branch0,
    ExtentY=explode_tree.Branch1,
    ExtentZ="1")

# ---- group: Find SWedge slope face plane pointing inwards
vector_2pt = Vector2Pt(PointA=face_normals.Centers, PointB=swedge_model_centroid_2, Unitize=False)  # -> Vector, Length
plane_normal_2 = PlaneNormal(Origin=face_normals.Centers, ZAxis=vector_2pt.Vector)
flip_plane = FlipPlane(Plane=plane_normal, Guide=plane_normal_2, FlipX=False, FlipY=False, FlipZ=True)  # -> Flipped, ResultBoolean

# ---- group: Filter out edge points with specified clearance
deconstruct_brep = DeconstructBrep(Brep=block_slope_face_2)  # -> Faces, Edges, Vertices
edge_clearance_m_3 = Number(edge_clearance_m_2)
join_curves = JoinCurves(Curves=deconstruct_brep.Edges, Preserve=False)
pull_point = PullPoint(Point=simplify(graft(points_subparallel_with_swedge_slope_fac_2)), Geometry=join_curves, ClosestOnly=False)  # -> ClosestPoint, simplify(Distance)
larger_than = LargerThan(FirstNumber=pull_point.Distance, SecondNumber=edge_clearance_m_3)  # -> LargerThan, OrEqualTo
mass_multiplication = MassMultiplication(Input=larger_than.LargerThan)  # -> flatten(Result), PartialResults
cull_pattern = CullPattern(List=points_subparallel_with_swedge_slope_fac_2, CullPattern=mass_multiplication.Result)
bolteable_points_on_point_cloud = Point(cull_pattern)

# ---- group: Find bolteable points on point cloud
deconstruct_cloud = DeconstructCloud(Cloud=cloud_grid)  # -> Points, Normals, Colors
arbitrary_maximum_distance_from_pointclo = Panel("0.1")  # "Arbitrary maximum distance from pointcloud to bolting options"
line_sdl = LineSDL(Start=deconstruct_cloud.Points, Direction=face_normals.Normals, Length="1")
deconstruct_plane = DeconstructPlane(Plane=flip_plane.Flipped)  # -> Origin, XAxis, YAxis, ZAxis
extend_curve = ExtendCurve(Curve=line_sdl, Type=0, Start="5", End="5")
first_last = FirstLast(List=extend_curve)  # -> FirstValue, LastValue
multiplication = Multiplication(A="5", B="2")
negative = Negative(Value=multiplication)
pull_point_2 = PullPoint(Point=bolteable_points_on_point_cloud, Geometry=extend_curve, ClosestOnly=True)  # -> ClosestPoint, Distance
smaller_than = SmallerThan(FirstNumber=pull_point_2.Distance, SecondNumber=arbitrary_maximum_distance_from_pointclo)  # -> SmallerThan, OrEqualTo
amplitude = Amplitude(Vector=deconstruct_plane.ZAxis, Amplitude=negative)
move = Move(Geometry=flip_plane.Flipped, Motion=amplitude)  # -> Geometry, Transform
cull_pattern_2 = CullPattern(List=pull_point_2.ClosestPoint, CullPattern=smaller_than.OrEqualTo)
sort_along_curve = SortAlongCurve(Points=cull_pattern_2, Curve=first_last.FirstValue)  # -> Points, Indices
addition = Addition(A=multiplication, B="5")
project = Project(Geometry=cull_pattern_2, Plane=move.Geometry)  # -> Geometry, Transform
vector_2pt_2 = Vector2Pt(PointA=cull_pattern_2, PointB=project.Geometry, Unitize=False)  # -> Vector, Length
cull_duplicates = CullDuplicates(Points=project.Geometry, Tolerance="0.25", CullMode=1)  # -> Points, Indices, Valence
line_sdl_2 = LineSDL(Start=cull_duplicates.Points, Direction=deconstruct_plane.ZAxis, Length=addition)
point_groups = PointGroups(Points=project.Geometry, Distance="0.25")  # -> Groups, simplify(Indices)
list_item = ListItem(List=cull_pattern_2, Index=point_groups.Indices, Wrap=True)
sort_along_curve_2 = SortAlongCurve(Points=list_item, Curve=simplify(graft(line_sdl_2)))  # -> Points, Indices
sort_points = SortPoints(Points=cull_duplicates.Points)  # -> Points, Indices
first_last_2 = FirstLast(List=sort_along_curve_2.Points)  # -> FirstValue, LastValue
point = Point(first_last_2.FirstValue)
bolting_point_options = Point(flatten(point))

# ----
bolting_point_options_2 = ClusterOutput(bolting_point_options)

# ==== cluster Cluster_3
e_cap_seismic = ClusterInput()

gamma_r = ClusterInput()
V = ClusterInput()
h_w = ClusterInput()
a_t = ClusterInput()
wedge_left_joint_mesh = ClusterInput()
wedge_right_joint_mesh = ClusterInput()
wedge_upper_face_mesh = ClusterInput()
left_joint_dip_direction = ClusterInput()
right_joint_dip_direction = ClusterInput()
phi_2 = ClusterInput()
wedge_slope_face_mesh = ClusterInput()
c_2 = ClusterInput()
phi_2_r = ClusterInput()
k = ClusterInput()
joint_water_pressure = ClusterInput()
percentage_fill = ClusterInput()
u_1 = ClusterInput()
u_2 = ClusterInput()
left_joint_dip = ClusterInput()
right_joint_dip = ClusterInput()
slope_dip = ClusterInput()
slope_dip_direction = ClusterInput()
phi_1_r = ClusterInput()
u_t = ClusterInput()
c_1 = ClusterInput()
phi_1 = ClusterInput()
e_cap_bolt_passive = ClusterInput()
e_cap_bolt_active = ClusterInput()
c_passive = ClusterInput()
c_active = ClusterInput()
e_cap_bolt_passive_2 = UnitDirectionOfPassiveBolt(e_cap_bolt_passive)
c_passive_2 = CapacityOfPassiveBolt(c_passive)
c_active_2 = CapcaityOfActiveBolt(c_active)
e_cap_bolt_active_2 = UnitDirectionOfActiveBolt(e_cap_bolt_active)
h_w_2 = VerticalHeightOfLineOfIntersection(h_w)
a_t_2 = AreaOfTensionCrack(a_t)
phi_2_2 = FrictionAngleOfJoint2(phi_2)
c_2_2 = CohesionOfJoint2(c_2)
left_joint_dip_2 = Number(left_joint_dip)
phi_2_r_2 = FrictionAngleOfJoint2(phi_2_r)
k_2 = Number(k)
e_cap_seismic_2 = DirectionOfSeismicForce(e_cap_seismic)
joint_water_pressure_2 = JointWaterPressure(joint_water_pressure)
percentage_fill_2 = PercentageFill(percentage_fill)
u_1_2 = ConstantPressureOnJoint1(u_1)
u_2_2 = ConstantPressureOnJoint2(u_2)
gamma_r_2 = UnitWeightOfRock(gamma_r)
V_2 = WedgeVolume(V)
phi_1_r_2 = FrictionAngleOfJoint1(phi_1_r)
wedge_left_joint_mesh_2 = Mesh(wedge_left_joint_mesh)
wedge_right_joint_mesh_2 = Mesh(wedge_right_joint_mesh)
wedge_slope_face_mesh_2 = Mesh(wedge_slope_face_mesh)
wedge_upper_face_mesh_2 = Mesh(wedge_upper_face_mesh)
left_joint_dip_direction_2 = Number(left_joint_dip_direction)
right_joint_dip_2 = Number(right_joint_dip)
right_joint_dip_direction_2 = Number(right_joint_dip_direction)
slope_dip_2 = Number(slope_dip)
slope_dip_direction_2 = Number(slope_dip_direction)
c_1_2 = CohesionOfJoint1(c_1)
phi_1_2 = FrictionAngleOfJoint1(phi_1)
u_t_2 = ConstantPressureOnTensionCrack(u_t)

# ----
# Active support - Ultimate load
# Active support - FS for shear failure
# Passive support - Ultimate laod
panel = Panel("0")

c_i = IndividualExternalForceVectors("{0,0,0}")

cluster = Cluster_2(
    unit_weight_of_rock=gamma_r_2,
    wedge_volume=V_2,
    vertical_height_of_line_of_intersection=h_w_2,
    area_of_tension_crack=a_t_2,
    wedge_left_joint_mesh=wedge_left_joint_mesh_2,
    wedge_right_joint_mesh=wedge_right_joint_mesh_2,
    wedge_slope_face_mesh=wedge_slope_face_mesh_2,
    wedge_upper_face_mesh=wedge_upper_face_mesh_2,
    left_joint_dip=left_joint_dip_2,
    left_joint_dip_direction=left_joint_dip_direction_2,
    right_joint_dip=right_joint_dip_2,
    right_joint_dip_direction=right_joint_dip_direction_2,
    slope_dip=slope_dip_2,
    slope_dip_direction=slope_dip_direction_2,
    cohesion_of_joint_1=c_1_2,
    friction_angle_of_joint_1=phi_1_2,
    cohesion_of_joint_2=c_2_2,
    friction_angle_of_joint_2=phi_2_2,
    k=k_2,
    direction_of_seismic_force=e_cap_seismic_2,
    individual_external_force_vectors=c_i,
    joint_water_pressure=joint_water_pressure_2,
    percentage_fill=percentage_fill_2,
    constant_pressure_on_joint_1=u_1_2,
    constant_pressure_on_joint_2=u_2_2,
    constant_pressure_on_tension_crack=u_t_2,
    capcaity_of_active_bolt=c_passive_2,
    unit_direction_of_active_bolt=e_cap_bolt_active_2,
    capacity_of_passive_bolt=panel,
    unit_direction_of_passive_bolt="{0,0,0}",
    trace_length_of_joint_1_on_slope_face=panel,
    trace_length_of_joint_2_on_slope_face=panel,
    shotcrete_thickness=panel,
    shotcrete_shear_strength=panel,
    active_pressure_magnitude_on_slope_face=panel,
    trend_plunge_of_active_slope_pressure="{0,0,0}",
    active_pressure_magnitude_on_upper_face=panel,
    trend_plunge_of_active_upper_face_pressu="{0,0,0}",
    passive_pressure_magnitude_on_slope_face=panel,
    trend_plunge_of_passive_slope_pressure="{0,0,0}",
    passive_pressure_magnitude_on_upper_face=panel,
    trend_plunge_of_passive_upper_face_press="{0,0,0}")  # -> factor_of_safety, sliding_direction_3
cluster_2 = Cluster_2(
    unit_weight_of_rock=gamma_r_2,
    wedge_volume=V_2,
    vertical_height_of_line_of_intersection=h_w_2,
    area_of_tension_crack=a_t_2,
    wedge_left_joint_mesh=wedge_left_joint_mesh_2,
    wedge_right_joint_mesh=wedge_right_joint_mesh_2,
    wedge_slope_face_mesh=wedge_slope_face_mesh_2,
    wedge_upper_face_mesh=wedge_upper_face_mesh_2,
    left_joint_dip=left_joint_dip_2,
    left_joint_dip_direction=left_joint_dip_direction_2,
    right_joint_dip=right_joint_dip_2,
    right_joint_dip_direction=right_joint_dip_direction_2,
    slope_dip=slope_dip_2,
    slope_dip_direction=slope_dip_direction_2,
    cohesion_of_joint_1=panel,
    friction_angle_of_joint_1=phi_1_r_2,
    cohesion_of_joint_2=panel,
    friction_angle_of_joint_2=phi_2_r_2,
    k=k_2,
    direction_of_seismic_force=e_cap_seismic_2,
    individual_external_force_vectors=c_i,
    joint_water_pressure=joint_water_pressure_2,
    percentage_fill=percentage_fill_2,
    constant_pressure_on_joint_1=u_1_2,
    constant_pressure_on_joint_2=u_2_2,
    constant_pressure_on_tension_crack=u_t_2,
    capcaity_of_active_bolt=panel,
    unit_direction_of_active_bolt=e_cap_bolt_active_2,
    capacity_of_passive_bolt=c_passive_2,
    unit_direction_of_passive_bolt="{0,0,0}",
    trace_length_of_joint_1_on_slope_face=panel,
    trace_length_of_joint_2_on_slope_face=panel,
    shotcrete_thickness=panel,
    shotcrete_shear_strength=panel,
    active_pressure_magnitude_on_slope_face=panel,
    trend_plunge_of_active_slope_pressure="{0,0,0}",
    active_pressure_magnitude_on_upper_face=panel,
    trend_plunge_of_active_upper_face_pressu="{0,0,0}",
    passive_pressure_magnitude_on_slope_face=panel,
    trend_plunge_of_passive_slope_pressure="{0,0,0}",
    passive_pressure_magnitude_on_upper_face=panel,
    trend_plunge_of_passive_upper_face_press="{0,0,0}")  # -> factor_of_safety, sliding_direction_3

cluster_3 = Cluster_2(
    unit_weight_of_rock=gamma_r_2,
    wedge_volume=V_2,
    vertical_height_of_line_of_intersection=h_w_2,
    area_of_tension_crack=a_t_2,
    wedge_left_joint_mesh=wedge_left_joint_mesh_2,
    wedge_right_joint_mesh=wedge_right_joint_mesh_2,
    wedge_slope_face_mesh=wedge_slope_face_mesh_2,
    wedge_upper_face_mesh=wedge_upper_face_mesh_2,
    left_joint_dip=left_joint_dip_2,
    left_joint_dip_direction=left_joint_dip_direction_2,
    right_joint_dip=right_joint_dip_2,
    right_joint_dip_direction=right_joint_dip_direction_2,
    slope_dip=slope_dip_2,
    slope_dip_direction=slope_dip_direction_2,
    cohesion_of_joint_1=c_1_2,
    friction_angle_of_joint_1=phi_1_2,
    cohesion_of_joint_2=c_2_2,
    friction_angle_of_joint_2=phi_2_2,
    k=k_2,
    direction_of_seismic_force=e_cap_seismic_2,
    individual_external_force_vectors=c_i,
    joint_water_pressure=joint_water_pressure_2,
    percentage_fill=percentage_fill_2,
    constant_pressure_on_joint_1=u_1_2,
    constant_pressure_on_joint_2=u_2_2,
    constant_pressure_on_tension_crack=u_t_2,
    capcaity_of_active_bolt=c_active_2,
    unit_direction_of_active_bolt=e_cap_bolt_active_2,
    capacity_of_passive_bolt=panel,
    unit_direction_of_passive_bolt="{0,0,0}",
    trace_length_of_joint_1_on_slope_face=panel,
    trace_length_of_joint_2_on_slope_face=panel,
    shotcrete_thickness=panel,
    shotcrete_shear_strength=panel,
    active_pressure_magnitude_on_slope_face=panel,
    trend_plunge_of_active_slope_pressure="{0,0,0}",
    active_pressure_magnitude_on_upper_face=panel,
    trend_plunge_of_active_upper_face_pressu="{0,0,0}",
    passive_pressure_magnitude_on_slope_face=panel,
    trend_plunge_of_passive_slope_pressure="{0,0,0}",
    passive_pressure_magnitude_on_upper_face=panel,
    trend_plunge_of_passive_upper_face_press="{0,0,0}")  # -> factor_of_safety, sliding_direction_3
panel_2 = Panel(cluster_3.sliding_direction_3)
larger_than = LargerThan(FirstNumber=cluster_3.factor_of_safety, SecondNumber="1")  # -> LargerThan, OrEqualTo
fs_c_active = Number(cluster.factor_of_safety)
panel_3 = Panel(cluster.sliding_direction_3)
panel_4 = Panel(cluster_2.sliding_direction_3)
fs_c_passive = Number(cluster_2.factor_of_safety)
pick_n_choose = PickNChoose(Pattern=larger_than.OrEqualTo, Stream0=fs_c_passive, Stream1=fs_c_active)

shear_failure_sliding_direction = Integer(cluster_3.sliding_direction_3)
fs_c = Number(pick_n_choose)
fs_s = Number(cluster_3.factor_of_safety)
shear_failure_sliding_direction_2 = ClusterOutput(shear_failure_sliding_direction)
fs_s_2 = ClusterOutput(fs_s)
fs_c_2 = ClusterOutput(fs_c)

fs_system = Number(fs_s)
fs_system_2 = ClusterOutput(fs_system)

# ==== cluster ApplyMaterialPartialFactor
c_1 = ClusterInput()
phi_1 = ClusterInput()
phi_1_r = ClusterInput()
c_2 = ClusterInput()
phi_2 = ClusterInput()
phi_2_r = ClusterInput()
c_1_2 = Number(c_1)
phi_1_2 = Number(phi_1)
phi_1_r_2 = Number(phi_1_r)
c_2_2 = Number(c_2)
phi_2_2 = Number(phi_2)
phi_2_r_2 = Number(phi_2_r)
entwine = Entwine(Branch00=phi_1_2, Branch01=phi_1_r_2, Branch02=phi_2_2, Branch03=phi_2_r_2, FlattenInputs=True)
radians = Radians(Degrees=phi_2_2)
entwine_2 = Entwine(Branch00=c_1_2, Branch01=c_2_2, FlattenInputs=True)
radians_2 = Radians(Degrees=entwine)
expression = Expression(phi=radians, Expression="Atan(tan(phi)/1.25)")
expression_2 = Expression(c=entwine_2, Expression="c/1.25")
expression_3 = Expression(phi=radians_2, Expression="Atan(tan(phi)/1.25)")
explode_tree = ExplodeTree(Data=expression_2)  # -> Branch0, Branch1
degrees = Degrees(Radians=expression)
degrees_2 = Degrees(Radians=expression_3)
explode_tree_2 = ExplodeTree(Data=degrees_2)  # -> Branch0, Branch1, Branch2, Branch3
c_2_3 = Number(explode_tree.Branch1)
phi_2_3 = Number(explode_tree_2.Branch2)
phi_2_r_3 = Number(explode_tree_2.Branch3)
c_1_3 = Number(explode_tree.Branch0)
phi_1_3 = Number(explode_tree_2.Branch0)
phi_1_r_3 = Number(explode_tree_2.Branch1)
c_1_4 = ClusterOutput(c_1_3)
phi_1_4 = ClusterOutput(phi_1_3)
phi_1_r_4 = ClusterOutput(phi_1_r_3)
c_2_4 = ClusterOutput(c_2_3)
phi_2_4 = ClusterOutput(phi_2_3)
phi_2_r_4 = ClusterOutput(phi_2_r_3)

# ==== cluster PointCloudSubparallelToSWedgeSlopeSurface
pointcloud_with_normals = ClusterInput()
swedge_slope_face_mesh = ClusterInput()
block_slope_surface = ClusterInput()
angle_tolerance_deg = ClusterInput()
angle_tolerance_deg_2 = Number(angle_tolerance_deg)
swedge_slope_face_mesh_2 = Mesh(swedge_slope_face_mesh)
block_slope_surface_2 = Brep(block_slope_surface)
pointcloud_with_normals_2 = PointCloud(pointcloud_with_normals)

# ---- group: Creating cropping mesh by extruding block slope surface and SWedge slope face
mesh_to_polysurface = MeshToPolysurface(Mesh=swedge_slope_face_mesh_2, Triangles=False, FaceMerge=False)

# ---- group: Get pointcloud subparallel to SWedge Slope Surface
face_normals = FaceNormals(Mesh=swedge_slope_face_mesh_2)  # -> Centers, Normals
expression = Expression(x=angle_tolerance_deg_2, Expression="180-x")
construct_domain = ConstructDomain(DomainStart=expression, DomainEnd="180")
construct_domain_2 = ConstructDomain(DomainStart=angle_tolerance_deg_2, DomainEnd=1)

# ----
amplitude = Amplitude(Vector=face_normals.Normals, Amplitude="2")
amplitude_2 = Amplitude(Vector=face_normals.Normals, Amplitude="-6")

# ---- group: Creating cropping mesh by extruding block slope surface and SWedge slope face (continued)
amplitude_3 = Amplitude(Vector=face_normals.Normals, Amplitude="0.5")
move = Move(Geometry=mesh_to_polysurface, Motion=amplitude_3)  # -> Geometry, Transform
move_2 = Move(Geometry=block_slope_surface_2, Motion=amplitude)  # -> Geometry, Transform
amplitude_4 = Amplitude(Vector=face_normals.Normals, Amplitude="-2")
extrude = Extrude(Base=move_2.Geometry, Direction=amplitude_2)
extrude_2 = Extrude(Base=move.Geometry, Direction=amplitude_4)
solid_intersection = SolidIntersection(BrepsA=extrude_2, BrepsB=extrude)
mesh_brep = MeshBrep(
    Brep=solid_intersection,
    Settings={GridMaxCount=0, GridMinCount=16, JaggedSeams=False, MaxEdgeLength=0, MinEdgeLength=0.0001, MinTolerance=0, Refine=True, RefineAngle=0, RelativeTolerance=0.65, SimplePlanes=True, Tolerance=0})
cropping_mesh_for_bolteable_pointcloud = Mesh(mesh_brep)

# ---- group: Trim cloud based on Wedge slope surface, then compute normals
cloudmeshcrop = CloudMeshCrop(PointCloud=pointcloud_with_normals_2, Meshes=cropping_mesh_for_bolteable_pointcloud, Inverse=False)
cloudexplode = CloudExplode(PointCloud=cloudmeshcrop)  # -> Points, Normals, Colors

# ---- group: Get pointcloud subparallel to SWedge Slope Surface (continued)
angle = Angle(VectorA=face_normals.Normals, VectorB=cloudexplode.Normals)  # -> Angle, Reflex
degrees = Degrees(Radians=angle.Angle)
includes = Includes(Value=degrees, Domain=[construct_domain_2, construct_domain])  # -> Includes, Deviation

# ----
cull_pattern = CullPattern(List=cloudexplode.Points, CullPattern=includes.Includes)
points_subparallel_to_swedge_slope_surfa = Point(cull_pattern)  # "Points subparallel to SWedge Slope Surface"
points_subparallel_to_swedge_slope_surfa_2 = ClusterOutput(points_subparallel_to_swedge_slope_surfa)  # "Points subparallel to SWedge Slope Surface"

# ==== cluster AvailableBoltPointsAndLines_2: Find available bolt points bolt lines grouped by bolt lengths based on minimum bolt spacing and bolt direction.
bolting_point_spacing_m = ClusterInput()

left_joint_trimmed_cutter_brep = ClusterInput()
right_joint_trimmed_cutter_brep = ClusterInput()
tension_crack_trimmed_cutter_brep = ClusterInput()
library_of_bolt_lengths_m = ClusterInput()
bolt_direction = ClusterInput()
swedge_model_slope_face_mesh = ClusterInput()
minimum_anchoring_length_m = ClusterInput()
bolting_point_options = ClusterInput()
swedge_model_slope_face_mesh_2 = Mesh(swedge_model_slope_face_mesh)
minimum_anchoring_length_m_2 = Number(minimum_anchoring_length_m)
bolting_point_spacing_m_2 = Number(bolting_point_spacing_m)
left_joint_trimmed_cutter_brep_2 = Brep(left_joint_trimmed_cutter_brep)
right_joint_trimmed_cutter_brep_2 = Brep(right_joint_trimmed_cutter_brep)
tension_crack_trimmed_cutter_brep_2 = Brep(tension_crack_trimmed_cutter_brep)
library_of_bolt_lengths_m_2 = Number(library_of_bolt_lengths_m)
bolt_direction_2 = Vector(bolt_direction)

bolting_point_options_2 = Point(bolting_point_options)

# ---- group: Cull bolting points based on bolting spacing
multiplication = Multiplication(A=bolting_point_spacing_m_2, B="0.9")
cull_duplicates = CullDuplicates(Points=bolting_point_options_2, Tolerance=multiplication, CullMode=1)  # -> Points, Indices, Valence
bolting_point = Point(cull_duplicates.Points)

# ---- group: Choose first N points with shortest drilling length / Joint brep of sliding planes and tension crack
brep_join = BrepJoin(Breps=flatten([left_joint_trimmed_cutter_brep_2, right_joint_trimmed_cutter_brep_2, tension_crack_trimmed_cutter_brep_2]))  # -> Breps, Closed

# ---- group: Choose first N points with shortest drilling length
project_point = ProjectPoint(Point=bolting_point, Direction=bolt_direction_2, Geometry=brep_join.Breps)  # -> Point, Index
line = Line(StartPoint=bolting_point, EndPoint=project_point.Point)
extend_curve = ExtendCurve(Curve=line, Type=0, Start="0", End=minimum_anchoring_length_m_2)
null_item = NullItem(Item=extend_curve)  # -> NullFlags, InvalidFlags, Description
cull_pattern = CullPattern(List=extend_curve, CullPattern=invert(null_item.NullFlags))
length = Length(Curve=cull_pattern)

# ---- group: Remap necessary bolt length to bolt library
library_of_bolt_lengths_m_3 = Number(library_of_bolt_lengths_m_2)
necessary_bolt_length = Number(length)
round_to_nearest = RoundToNearest(NumbersX=necessary_bolt_length, NumbersY=library_of_bolt_lengths_m_3, RemapX=False)  # -> Nearest, Index, Difference, RemappedX
expression = Expression(x=necessary_bolt_length, Nearest=round_to_nearest.Nearest, Expression="If(Nearest<x, 1, 0)")
addition = Addition(A=expression, B=round_to_nearest.Index)
list_item = ListItem(List=library_of_bolt_lengths_m_3, Index=addition, Wrap=invert(True))
standard_bolt_lengths = Number(flatten(list_item))

# ---- group: Sort bolt length, return exact number of required bolts
null_item_2 = NullItem(Item=list_item)  # -> NullFlags, InvalidFlags, Description
round_to_decimal_place = RoundToDecimalPlace(NumberX=library_of_bolt_lengths_m_3, DecimalPlace="1", RoundType=0)  # -> Rounded, Difference

# ---- group: Sort bolt length, return exact number of required bolts / Remove bolt point if standard bolt length not possible
cull_pattern_2 = CullPattern(List=bolting_point, CullPattern=invert(null_item_2.NullFlags))

# ---- group: Sort bolt length, return exact number of required bolts / Remove bolt length if standard bolt length not possible
cull_pattern_3 = CullPattern(List=list_item, CullPattern=invert(null_item_2.NullFlags))

# ---- group: Sort bolt length, return exact number of required bolts (continued)
line_sdl = LineSDL(Start=cull_pattern_2, Direction=bolt_direction_2, Length=cull_pattern_3)
length_2 = Length(Curve=line_sdl)
round_to_decimal_place_2 = RoundToDecimalPlace(NumberX=length_2, DecimalPlace="1", RoundType=0)  # -> Rounded, Difference
equality = Equality(FirstNumber=round_to_decimal_place_2.Rounded, SecondNumber=graft(round_to_decimal_place.Rounded))  # -> Equality, Inequality
mass_addition = MassAddition(Input=equality.Equality)  # -> simplify(Result), PartialResults
available_bolt_points_numbers_grouped_by = Integer(mass_addition.Result)  # "Available bolt points numbers grouped by lengths"

# ----
cull_pattern_4 = CullPattern(List=line_sdl, CullPattern=equality.Equality)  # -> simplify(List)
available_bolt_lines = Line(cull_pattern_4)

available_bolt_points_numbers_grouped_by_2 = ClusterOutput(available_bolt_points_numbers_grouped_by)  # "Available bolt points numbers grouped by lengths"
available_bolt_lines_2 = ClusterOutput(available_bolt_lines)

# ==== cluster WedgeVolume_Cloud_CutterSurface2Brep
lower_bounding_xy_plane = ClusterInput()
patch_surface = ClusterInput()
cloud = ClusterInput()
point_in_wedge = ClusterInput()
leftjointsurface = ClusterInput()
rightjointsurface = ClusterInput()
tensioncracksurface = ClusterInput()
clip_lower_boundary = ClusterInput()

# ---- group: Inputs
point_in_wedge_2 = Point(point_in_wedge)
leftjointsurface_2 = Surface(leftjointsurface)
rightjointsurface_2 = Surface(rightjointsurface)
tensioncracksurface_2 = Surface(tensioncracksurface)
cloud_2 = Cloud(cloud)

# ----
patch_surface_2 = Brep(patch_surface)
clip_lower_boundary_2 = Boolean(clip_lower_boundary)

# ----
# 1. Trim PointCloud with cutter Planes
# Left joint
is_planar = IsPlanar(Surface=leftjointsurface_2, Interior=True)  # -> Planar, Plane
is_planar_2 = IsPlanar(Surface=tensioncracksurface_2, Interior=True)  # -> Planar, Plane
is_planar_3 = IsPlanar(Surface=rightjointsurface_2, Interior=True)  # -> Planar, Plane
re_orient_cutter_plane = ReOrientCutterPlane(point_in_wedge=point_in_wedge_2, cutter_plane=is_planar.Plane)
# Right joint
re_orient_cutter_plane_2 = ReOrientCutterPlane(point_in_wedge=point_in_wedge_2, cutter_plane=is_planar_3.Plane)
# Tension crack
re_orient_cutter_plane_3 = ReOrientCutterPlane(point_in_wedge=point_in_wedge_2, cutter_plane=is_planar_2.Plane)
merge = Merge(Data1=re_orient_cutter_plane, Data2=re_orient_cutter_plane_2, Data3=re_orient_cutter_plane_3)  # -> flatten(Result)

# ----
# 0. Unit vector pointing inwards from line of intersection along XY plane
brep_brep = BrepBrep(BrepA=leftjointsurface_2, BrepB=rightjointsurface_2)  # -> Curves, Points
end_points = EndPoints(Curve=brep_brep.Curves)  # -> Start, End
deconstruct = Deconstruct(Point=end_points.Start)  # -> XComponent, YComponent, ZComponent
deconstruct_2 = Deconstruct(Point=end_points.End)  # -> XComponent, YComponent, ZComponent
smaller_than = SmallerThan(FirstNumber=deconstruct.ZComponent, SecondNumber=deconstruct_2.ZComponent)  # -> SmallerThan, OrEqualTo
line = Line(StartPoint=end_points.End, EndPoint=end_points.Start)
pick_n_choose = PickNChoose(Pattern=smaller_than.OrEqualTo, Stream0=line, Stream1=brep_brep.Curves)
project = Project(Geometry=pick_n_choose, Plane=PlaneXY(0, 0, 0))  # -> Geometry, Transform
unit_vector = UnitVector(Vector=project.Geometry)

# ---- group: Determine best-fit plane and Z-axis of patch surface outline
brep = Brep(patch_surface_2)
# 3. Create solid from patch surface and ruled surface
brep_edges = BrepEdges(Brep=brep)  # -> Naked, Interior, NonManifold
join_curves = JoinCurves(Curves=brep_edges.Naked, Preserve=False)
explode = Explode(Curve=join_curves, Recursive=True)  # -> Segments, Vertices
plane_normal = PlaneNormal(Origin=Point(0, 0, 0), ZAxis=unit_vector)
plane_fit = PlaneFit(Points=explode.Vertices)  # -> Plane, Deviation
flip_plane = FlipPlane(Plane=plane_fit.Plane, Guide=plane_normal, FlipX=False, FlipY=False, FlipZ=True)  # -> Flipped, ResultBoolean
deconstruct_plane = DeconstructPlane(Plane=flip_plane.Flipped)  # -> Origin, XAxis, YAxis, ZAxis

# ----
# 2. Create bounding box of point cloud, then split with cutting planes
cloud_3 = Cloud(cloud_2)

# ---- group: Find highest point of wedge
bounding_rectangle = BoundingRectangle(Geometry=cloud_3, Plane=PlaneXY(0, 0, 0), Axis=0, Slide="1", Union=True)  # -> Bounding, DimensionX, DimensionY
line_plane = LinePlane(Line=brep_brep.Curves, Plane=bounding_rectangle.Bounding)  # -> Point, ParamL, ParamP

# ---- group: Determine daylighting point (maybe empty)
brep_line = BrepLine(Brep=patch_surface_2, Line=brep_brep.Curves, LimitToFirst=False)  # -> Curves, flatten(Points)
deconstruct_3 = Deconstruct(Point=brep_line.Points)  # -> XComponent, YComponent, ZComponent
sort_list = SortList(Keys=deconstruct_3.ZComponent, ValuesValuesA=brep_line.Points)  # -> Keys, ValuesValuesA
daylighting_point = Point(sort_list.ValuesValuesA)

# ----
lower_bounding_xy_plane_2 = Plane(lower_bounding_xy_plane)

# ---- group: Create bounding box with highest and lowest possible points
plane_normal_2 = PlaneNormal(Origin=Point(0, 0, 0), ZAxis=unit_vector)
bounding_box = BoundingBox(Content=flatten([cloud_3, line_plane.Point, daylighting_point]), Plane=plane_normal_2, UnionBox=True)  # -> Box, Box_2

# ---- group: Clip bounding box with lower boundary
brep_plane = BrepPlane(Brep=bounding_box.Box, Plane=lower_bounding_xy_plane_2)  # -> Curves, Points
split_brep = SplitBrep(Brep=bounding_box.Box, Cutter=brep_plane.Curves)
cap_holes = CapHoles(Brep=split_brep)
point_in_brep = PointInBrep(Brep=cap_holes, Point=point_in_wedge_2, Strict=False)
cull_pattern = CullPattern(List=cap_holes, CullPattern=point_in_brep)

# ---- group: Pick lower bounding plane if yes
pick_n_choose_2 = PickNChoose(Pattern=clip_lower_boundary_2, Stream0=bounding_box.Box, Stream1=cull_pattern)
relevant_bounding_box = Brep(pick_n_choose_2)

# ---- group: Create solid with patch surface
bounding_rectangle_2 = BoundingRectangle(Geometry=relevant_bounding_box, Plane=flip_plane.Flipped, Axis=0, Slide="1", Union=True)  # -> Bounding, DimensionX, DimensionY
project_along = ProjectAlong(Geometry=join_curves, Plane=bounding_rectangle_2.Bounding, Direction=deconstruct_plane.ZAxis)  # -> Geometry, Transform
ruled_surface = RuledSurface(CurveA=join_curves, CurveB=project_along.Geometry)
brep_2 = Brep(project_along.Geometry)
brep_join = BrepJoin(Breps=flatten([brep_2, ruled_surface, brep]))  # -> Breps, Closed
closed_brep_from_patch_surface = Brep(brep_join.Breps)

# ----
line_plane_2 = LinePlane(Line=line, Plane=lower_bounding_xy_plane_2)  # -> Point, ParamL, ParamP

# ---- group: Trim point cloud with cutter planes and get 3D convex hull polygon
plane_clip = PlaneClip(Plane=merge)
cloud_engine = CloudEngine(Cloud=cloud_2, Instruction0=plane_clip)
deconstruct_cloud = DeconstructCloud(Cloud=cloud_engine)  # -> Points, Normals, Colors
convex_hull = ConvexHull(Points=deconstruct_cloud.Points, Plane=PlaneXY(0, 0, 0))  # -> Hull, HullZ, Indices

# ---- group: trim away lower half of 3D convex hull polygon
patch = Patch(Curves=convex_hull.HullZ, Spans="2", Flexibility=1, Trim=True)
area = Area(Geometry=patch)  # -> Area, Centroid
xy_plane = XYPlane(Origin=area.Centroid)
plane_trim_curve = PlaneTrimCurve(Curve=convex_hull.HullZ, Plane=xy_plane, Flip=False)  # -> Trimmed, Parameters, Intersected

# ---- group: Extrude the curve with an arbitrary length
amplitude = Amplitude(Vector=unit_vector, Amplitude="25")
amplitude_2 = Amplitude(Vector=unit_vector, Amplitude="-50")
move = Move(Geometry=plane_trim_curve.Trimmed, Motion=amplitude)  # -> Geometry, Transform
extrude = Extrude(Base=move.Geometry, Direction=amplitude_2)

# ----
# 5. Get wedge as solid, then trim the top.
extruded_brep = Brep(extrude)
curve = Curve(plane_trim_curve.Trimmed)
vector = Vector(unit_vector)

# ---- group: Get top trimming curve (ensure curve is not folding below)
unit_z = UnitZ(Factor=1)
unit_z_2 = UnitZ(Factor=1)
construct_plane = ConstructPlane(Origin=Point(0, 0, 0), XAxis=vector, YAxis=Vector(0, 1, 0))
flip_plane_2 = FlipPlane(Plane=construct_plane, Guide=unit_z_2, FlipX=False, FlipY=False, FlipZ=True)  # -> Flipped, ResultBoolean
bounding_box_2 = BoundingBox(Content=extruded_brep, Plane=flip_plane_2.Flipped, UnionBox=True)  # -> Box, Box_2
evaluate_box = EvaluateBox(Box=bounding_box_2.Box, UParameter=0.5, VParameter=0.5, WParameter="1.2")  # -> Plane, Point, Include
bounding_rectangle_3 = BoundingRectangle(Geometry=extruded_brep, Plane=evaluate_box.Plane, Axis=0, Slide="1.2", Union=True)  # -> Bounding, DimensionX, DimensionY
brep_3 = Brep(bounding_rectangle_3.Bounding)
explode_2 = Explode(Curve=curve, Recursive=True)  # -> Segments, Vertices
curve_middle = CurveMiddle(Curve=explode_2.Segments)
project_point = ProjectPoint(Point=curve_middle, Direction=unit_z, Geometry=brep_3)  # -> Point, Index
line_2 = Line(StartPoint=curve_middle, EndPoint=project_point.Point)
brep_line_2 = BrepLine(Brep=extruded_brep, Line=line_2, LimitToFirst=False)  # -> Curves, Points
list_length = ListLength(List=brep_line_2.Points)  # -> flatten(Length)
larger_than = LargerThan(FirstNumber=list_length, SecondNumber="1")  # -> LargerThan, OrEqualTo
cull_pattern_2 = CullPattern(List=explode_2.Segments, CullPattern=invert(larger_than.LargerThan))
join_curves_2 = JoinCurves(Curves=cull_pattern_2, Preserve=False)
extend_curve = ExtendCurve(Curve=join_curves_2, Type=0, Start="50", End="50")

# ---- group: Extrude the curve with an arbitrary length to both side, then extrude upwards to form a closed brep
move_2 = Move(Geometry=extend_curve, Motion=amplitude)  # -> Geometry, Transform
extrude_2 = Extrude(Base=move_2.Geometry, Direction=amplitude_2)
unit_z_3 = UnitZ(Factor=Slider(100, range=0..100))
extrude_3 = Extrude(Base=extrude_2, Direction=unit_z_3)
top_trimming_solid = Brep(extrude_3)

# ---- group: Splitting bounding box by solid difference
deconstruct_plane_2 = DeconstructPlane(Plane=merge)  # -> Origin, XAxis, YAxis, ZAxis
brep_plane_2 = BrepPlane(Brep=relevant_bounding_box, Plane=merge)  # -> simplify(Curves), Points
brep_4 = Brep(brep_plane_2.Curves)
amplitude_3 = Amplitude(Vector=deconstruct_plane_2.ZAxis, Amplitude="-50")
area_2 = Area(Geometry=brep_4)  # -> Area, Centroid
scale = Scale(Geometry=brep_4, Center=area_2.Centroid, Factor="3")  # -> Geometry, Transform
extrude_4 = Extrude(Base=scale.Geometry, Direction=simplify(graft(amplitude_3)))
solid_union = SolidUnion(Breps=flatten(extrude_4))

# ---- group: Splitting bounding box by solid difference / Solid bounding wedge
solid_difference = SolidDifference(BrepsA=relevant_bounding_box, BrepsB=solid_union)

# ---- group: Splitting bounding box by solid difference (continued)
closed_brep_from_splitted_bounding_box = Brep(solid_difference)

# ---- group: Solid intersection
solid_intersection = SolidIntersection(BrepsA=flatten(closed_brep_from_splitted_bounding_box), BrepsB=flatten(closed_brep_from_patch_surface))  # -> flatten(Result)
brep_closest_point = BrepClosestPoint(Point=point_in_wedge_2, Brep=solid_intersection)  # -> Point, Normal, Distance
sort_list_2 = SortList(Keys=brep_closest_point.Distance, ValuesValuesA=solid_intersection)  # -> Keys, ValuesValuesA
first_last = FirstLast(List=sort_list_2.ValuesValuesA)  # -> FirstValue, LastValue
top_untrimmed_wedge_brep = Brep(first_last.LastValue)

# ---- group: Split brep and determine the final wedge
solid_difference_2 = SolidDifference(BrepsA=top_untrimmed_wedge_brep, BrepsB=extrude_3)
wedge_brep = Brep(solid_difference_2)

# ----
# 6. Get the trimmed cutter breps on the wedge
deconstruct_brep = DeconstructBrep(Brep=wedge_brep)  # -> Faces, Edges, Vertices
area_3 = Area(Geometry=deconstruct_brep.Faces)  # -> Area, Centroid
point_plane_side = PointPlaneSide(Point=area_3.Centroid, Plane=graft(merge))  # -> Side, Front, Back, Distance
invert_boolean = InvertBoolean(Boolean=point_plane_side.Side)  # -> Inverted, Number

# ----
# 7. Get the trimmed slope surface of the wedge
brep_closest_point_2 = BrepClosestPoint(Point=point_in_wedge_2, Brep=deconstruct_brep.Faces)  # -> Point, Normal, Distance
sort_list_3 = SortList(Keys=brep_closest_point_2.Distance, ValuesValuesA=deconstruct_brep.Faces)  # -> Keys, ValuesValuesA
first_last_2 = FirstLast(List=sort_list_3.ValuesValuesA)  # -> FirstValue, LastValue
block_slope_surface = Brep(first_last_2.FirstValue)

# ---- group: If the cutter plane is null, the Point Plane Side results will just be zeros
mass_addition = MassAddition(Input=point_plane_side.Side)  # -> flatten(Result), PartialResults
equality = Equality(FirstNumber=mass_addition.Result, SecondNumber="0")  # -> Equality, Inequality
invert_boolean_2 = InvertBoolean(Boolean=equality.Equality)  # -> Inverted, Number

# ----
area_4 = Area(Geometry=block_slope_surface)  # -> Area, Centroid
square_root = SquareRoot(Value=area_4.Area)
multiplication = Multiplication(A=square_root, B="10")

multiplication_2 = Multiplication(A=invert_boolean.Inverted, B=graft(invert_boolean_2.Inverted))
cull_pattern_3 = CullPattern(List=deconstruct_brep.Faces, CullPattern=simplify(multiplication_2))  # -> simplify(List)

brep_join_2 = BrepJoin(Breps=cull_pattern_3)  # -> Breps, Closed

panel = Panel(brep_join_2.Breps)
trimmed_cutter_breps_on_wedge = Brep(brep_join_2.Breps)

explode_tree = ExplodeTree(Data=graft(trimmed_cutter_breps_on_wedge))  # -> Branch0, Branch1, Branch2

# ---- group: Output
left_joint_trimmed_cutter_brep = Brep(explode_tree.Branch0)
tension_crack_trimmed_cutter_brep = Brep(explode_tree.Branch2)
wedge_brep_2 = Brep(wedge_brep)
right_joint_trimmed_cutter_brep = Brep(explode_tree.Branch1)
block_slope_surface_2 = Surface(block_slope_surface)

# ----
wedge_brep_3 = ClusterOutput(wedge_brep_2)
left_joint_trimmed_cutter_brep_2 = ClusterOutput(left_joint_trimmed_cutter_brep)
right_joint_trimmed_cutter_brep_2 = ClusterOutput(right_joint_trimmed_cutter_brep)
tension_crack_trimmed_cutter_brep_2 = ClusterOutput(tension_crack_trimmed_cutter_brep)
block_slope_surface_3 = ClusterOutput(block_slope_surface_2)

# ==== cluster MeshDipDipDirection
mesh = ClusterInput()
surface = Surface([<surface referenced from the Rhino model> x2])
mesh_2 = Mesh(mesh)
mesh_brep = MeshBrep(
    Brep=surface,
    Settings={GridMaxCount=0, GridMinCount=16, JaggedSeams=False, MaxEdgeLength=0, MinEdgeLength=0.0001, MinTolerance=0, Refine=True, RefineAngle=0, RelativeTolerance=0.65, SimplePlanes=True, Tolerance=0})

# ----
# Get dip and dip direction of mesh
face_normals = FaceNormals(Mesh=mesh_2)  # -> Centers, Normals
average = Average(Input=face_normals.Normals)  # -> flatten(ArithmeticMean)
null_item = NullItem(Item=average)  # -> NullFlags, InvalidFlags, Description
list_indices = ListIndices(List=average)
cull_pattern = CullPattern(List=list_indices, CullPattern=null_item.NullFlags)
replace_items = ReplaceItems(List=average, Item="{0,0,0}", Indices=cull_pattern, Wrap=False)
deconstruct_vector = DeconstructVector(Vector=replace_items)  # -> XComponent, YComponent, ZComponent
larger_than = LargerThan(FirstNumber=deconstruct_vector.ZComponent, SecondNumber="0")  # -> LargerThan, OrEqualTo
vector_xyz = VectorXYZ(XComponent=deconstruct_vector.XComponent, YComponent=deconstruct_vector.YComponent, ZComponent=0)  # -> Vector, Length
reverse = Reverse(Vector=vector_xyz.Vector)
pick_n_choose = PickNChoose(Pattern=larger_than.LargerThan, Stream0=reverse, Stream1=vector_xyz.Vector)
deconstruct_vector_2 = DeconstructVector(Vector=pick_n_choose)  # -> XComponent, YComponent, ZComponent
unit_y = UnitY(Factor=1)
larger_than_2 = LargerThan(FirstNumber=deconstruct_vector_2.XComponent, SecondNumber="0")  # -> LargerThan, OrEqualTo
angle = Angle(VectorA=vector_xyz.Vector, VectorB=average)  # -> Angle, Reflex
angle_2 = Angle(VectorA=unit_y, VectorB=pick_n_choose)  # -> Angle, Reflex
degrees = Degrees(Radians=angle.Angle)
pick_n_choose_2 = PickNChoose(Pattern=larger_than_2.LargerThan, Stream0=angle_2.Reflex, Stream1=angle_2.Angle)
subtraction = Subtraction(A="90", B=degrees)
degrees_2 = Degrees(Radians=pick_n_choose_2)
absolute = Absolute(Value=subtraction)

# ----
# Return to "null" if input is "null"
null_item_2 = NullItem(Item=degrees)  # -> NullFlags, InvalidFlags, Description
list_indices_2 = ListIndices(List=null_item_2.NullFlags)
cull_pattern_2 = CullPattern(List=list_indices_2, CullPattern=null_item_2.NullFlags)
replace_items_2 = ReplaceItems(List=absolute, Indices=cull_pattern_2, Wrap=False)

dip_deg = Panel(replace_items_2)

dip_deg_2 = Integer(replace_items_2)
dip_direction_deg = Integer(degrees_2)
concatenate = Concatenate(Fragment_A=dip_deg_2, A="/", Fragment_B=dip_direction_deg)
panel = Panel(dip_direction_deg)
panel_2 = Panel(dip_deg_2)
dip_dipdirection = Text(concatenate)
dip_direction_deg_2 = ClusterOutput(dip_direction_deg)
dip_dipdirection_2 = ClusterOutput(dip_dipdirection)
dip_deg_3 = ClusterOutput(dip_deg_2)

# ==== cluster ConstructSwedgeModel

upper_face_width_end_point = ClusterInput()
swedge_bottom_point = ClusterInput()
right_slope_crest_point = ClusterInput()
left_slope_crest_point = ClusterInput()
upper_face_width_end_point_2 = Point(upper_face_width_end_point)
left_slope_crest_point_2 = Point(left_slope_crest_point)
right_slope_crest_point_2 = Point(right_slope_crest_point)
swedge_bottom_point_2 = Point(swedge_bottom_point)
entwine = Entwine(
    Branch00=upper_face_width_end_point_2,
    Branch01=left_slope_crest_point_2,
    Branch02=right_slope_crest_point_2,
    Branch03=swedge_bottom_point_2,
    FlattenInputs=True)  # -> flatten(Result)
list_indices = ListIndices(List=entwine)  # -> graft(Indices)
explode_tree = ExplodeTree(Data=list_indices)  # -> Branch0, Branch1, Branch2, Branch3

# ---- group: Upper face
mesh_triangle = MeshTriangle(CornerA=explode_tree.Branch0, CornerB=explode_tree.Branch1, CornerC=explode_tree.Branch2)

# ---- group: Left face
mesh_triangle_2 = MeshTriangle(CornerA=explode_tree.Branch0, CornerB=explode_tree.Branch1, CornerC=explode_tree.Branch3)

# ---- group: Right face
mesh_triangle_3 = MeshTriangle(CornerA=explode_tree.Branch0, CornerB=explode_tree.Branch2, CornerC=explode_tree.Branch3)

# ---- group: Slope face
mesh_triangle_4 = MeshTriangle(CornerA=explode_tree.Branch1, CornerB=explode_tree.Branch2, CornerC=explode_tree.Branch3)

# ----
entwine_2 = Entwine(Branch00=mesh_triangle, Branch01=mesh_triangle_2, Branch02=mesh_triangle_4, Branch03=mesh_triangle_3, FlattenInputs=True)  # -> flatten(Result)

construct_mesh = ConstructMesh(Vertices=flatten(entwine), Faces=flatten(entwine_2))
close_mesh = CloseMesh(Mesh=construct_mesh, Quadrangulate=True)  # -> Closed, Amount, Openings, ResultBoolean
swedge_model_mesh = Mesh(close_mesh.Closed)

mesh_explode = MeshExplode(M=construct_mesh, N=True)  # -> out, graft(A); inputs M: Mesh
# ---------- mesh_explode: VB ----------
    Component.Params.Input(0).Name = "Mesh"
    Component.Params.Input(0).Description = "Open or closed mesh"
    Component.Params.Input(1).Name = "Modify Normals"
    Component.Params.Input(1).Description = "An optional boolean that specifies whether vertex normals will be maintained if false or recalculated with the new face"

    Component.Params.Output(1).Name = "Mesh"
    Component.Params.Output(1).Description = "If successful, a list of valid meshes"

    If m IsNot Nothing Then
      Dim i As Integer

      Dim clrB As Boolean
      Dim mshs As New list(Of mesh)
      Dim mf As Rhino.Geometry.Collections.MeshFaceList = Nothing
      Dim mv As Rhino.Geometry.Collections.MeshVertexList = Nothing
      Dim mn As Rhino.Geometry.Collections.MeshVertexNormalList = Nothing
      Dim mc As Rhino.Geometry.Collections.MeshVertexColorList = Nothing

      If m.VertexColors.count() > 0 Then clrB = True Else m.VertexColors.CreateMonotoneMesh(color.White)
      If m.Normals.Count() < 1 Then m.Normals.ComputeNormals()
      mf = m.Faces
      mv = m.Vertices
      mn = m.Normals
      mc = m.VertexColors

      For i = 0 To mf.Count() - 1 Step 1
        Dim pts As New list(Of point3d)
        Dim fc As New meshFace
        Dim clr As New list(Of Color)
        Dim vec As New list(Of Vector3f)
        Dim msh As New mesh

        pts.add(New point3d(mv(mf(i).A)))
        pts.add(New point3d(mv(mf(i).B)))
        pts.add(New point3d(mv(mf(i).C)))
        If mf(i).IsQuad Then pts.add(New point3d(mv(mf(i).D)))

        clr.add(mc(mf(i).A))
        clr.add(mc(mf(i).B))
        clr.add(mc(mf(i).C))
        If mf(i).IsQuad Then clr.add(mc(mf(i).D))

        If N Then
          vec.add(mn(mf(i).A))
          vec.add(mn(mf(i).B))
          vec.add(mn(mf(i).C))
          If mf(i).IsQuad Then vec.add(mn(mf(i).D))
        End If

        If mf(i).IsQuad Then fc = New meshFace(0, 1, 2, 3) Else fc = New meshface(0, 1, 2)

        msh.Vertices.AddVertices(pts.toarray())
        msh.Faces.AddFace(fc)
        If clrB Then msh.VertexColors.AppendColors(clr.toarray())
        If N Then msh.Normals.AddRange(vec.toarray()) Else msh.Normals.ComputeNormals()
        mshs.add(msh)
      Next

      A = mshs
    End If
# ---------- end mesh_explode ----------
explode_tree_2 = ExplodeTree(Data=mesh_explode.A)  # -> Branch0, Branch1, Branch2, Branch3
left_joint_face_mesh = Mesh(explode_tree_2.Branch1)
right_joint_face_mesh = Mesh(explode_tree_2.Branch3)
upper_face_mesh = Mesh(explode_tree_2.Branch0)
slope_face_mesh = Mesh(explode_tree_2.Branch2)
slope_face_mesh_2 = ClusterOutput(slope_face_mesh)
upper_face_mesh_2 = ClusterOutput(upper_face_mesh)
swedge_model_mesh_2 = ClusterOutput(swedge_model_mesh)
left_joint_face_mesh_2 = ClusterOutput(left_joint_face_mesh)
right_joint_face_mesh_2 = ClusterOutput(right_joint_face_mesh)

# ==== cluster DipDipDirectionToPlane

dip_deg = ClusterInput()
dip_direction_deg = ClusterInput()
origin = ClusterInput()
dip_direction_deg_2 = Number(dip_direction_deg)
dip_deg_2 = Number(dip_deg)
origin_2 = Point(origin)

# ---- group: Rotate plane to specific dip
xy_plane = XYPlane(Origin=origin_2)
radians = Radians(Degrees=dip_deg_2)
negative = Negative(Value=radians)
yz_plane = YZPlane(Origin=origin_2)
rotate = Rotate(Geometry=xy_plane, Angle=negative, Plane=yz_plane)  # -> Geometry, Transform

# ---- group: Rotate plane to specific dip direction (y-axis of plane)
radians_2 = Radians(Degrees=dip_direction_deg_2)
negative_2 = Negative(Value=radians_2)
rotate_2 = Rotate(Geometry=rotate.Geometry, Angle=negative_2, Plane=xy_plane)  # -> Geometry, Transform
face_normals = FaceNormals(Mesh=rotate_2.Geometry)  # -> Centers, Normals

# ----
plane = Plane(rotate_2.Geometry)
plane_2 = ClusterOutput(plane)

plane_normal = Vector(face_normals.Normals)
plane_normal_2 = ClusterOutput(plane_normal)

# ==== cluster Cluster

vector = ClusterInput()
vector_2 = Vector(vector)
deconstruct_vector = DeconstructVector(Vector=unitize(vector_2))  # -> XComponent, YComponent, ZComponent
unit_y = UnitY(Factor=1)
arctangent = ArcTangent(Value=deconstruct_vector.ZComponent)
negative = Negative(Value=arctangent)
xy_plane = XYPlane(Origin=Point(0, 0, 0))
angle = Angle(VectorA=vector_2, VectorB=unit_y, Plane=xy_plane)  # -> Angle, Reflex
degrees = Degrees(Radians=negative)  # -> flatten(Degrees)
degrees_2 = Degrees(Radians=angle.Angle)  # -> flatten(Degrees)
plunge = Number(degrees)
trend = Number(degrees_2)
trend_2 = ClusterOutput(trend)  # Degree
plunge_2 = ClusterOutput(plunge)  # Degree (upwards = -ve)

# ==== cluster Cluster_2

left_joint_dip = ClusterInput()
left_joint_dip_direction = ClusterInput()
right_joint_dip = ClusterInput()
right_joint_dip_direction = ClusterInput()
slope_dip = ClusterInput()
slope_dip_direction = ClusterInput()
tension_crack_dip_direction = Number("0")
tension_crack_dip = Number("0")
left_joint_dip_2 = Number(left_joint_dip)
left_joint_dip_direction_2 = Number(left_joint_dip_direction)
right_joint_dip_2 = Number(right_joint_dip)
right_joint_dip_direction_2 = Number(right_joint_dip_direction)
slope_dip_2 = Number(slope_dip)
slope_dip_direction_2 = Number(slope_dip_direction)
dip_dipdirection_to_plane = DipDipDirectionToPlane(
    dip_deg=left_joint_dip_2,
    dip_direction_deg=left_joint_dip_direction_2,
    origin=Point(353.9549866, 506.8420105, 44.99300003))  # -> plane_2, plane_normal_2
dip_dipdirection_to_plane_2 = DipDipDirectionToPlane(
    dip_deg=right_joint_dip_2,
    dip_direction_deg=right_joint_dip_direction_2,
    origin=Point(353.9549866, 506.8420105, 44.99300003))  # -> plane_2, plane_normal_2
dip_dipdirection_to_plane_3 = DipDipDirectionToPlane(dip_deg=slope_dip_2, dip_direction_deg=slope_dip_direction_2, origin=Point(353.9549866, 506.8420105, 44.99300003))  # -> plane_2, plane_normal_2
dip_dipdirection_to_plane_4 = DipDipDirectionToPlane(
    dip_deg=tension_crack_dip,
    dip_direction_deg=tension_crack_dip_direction,
    origin=Point(353.9549866, 506.8420105, 44.99300003))  # -> plane_2, plane_normal_2
deconstruct_plane = DeconstructPlane(Plane=dip_dipdirection_to_plane.plane_2)  # -> Origin, XAxis, YAxis, ZAxis
deconstruct_plane_2 = DeconstructPlane(Plane=dip_dipdirection_to_plane_2.plane_2)  # -> Origin, XAxis, YAxis, ZAxis

wedge_left_joint_mesh = ClusterInput()
wedge_right_joint_mesh = ClusterInput()
wedge_slope_face_mesh = ClusterInput()
wedge_upper_face_mesh = ClusterInput()
wedge_right_joint_mesh_2 = Mesh(wedge_right_joint_mesh)
wedge_left_joint_mesh_2 = Mesh(wedge_left_joint_mesh)
wedge_slope_face_mesh_2 = Mesh(wedge_slope_face_mesh)
wedge_upper_face_mesh_2 = Mesh(wedge_upper_face_mesh)
area = Area(Geometry=wedge_left_joint_mesh_2)  # -> Area, Centroid
area_2 = Area(Geometry=wedge_slope_face_mesh_2)  # -> Area, Centroid
area_3 = Area(Geometry=wedge_right_joint_mesh_2)  # -> Area, Centroid
area_4 = Area(Geometry=wedge_upper_face_mesh_2)  # -> Area, Centroid

# ---- group: Wedge rock properties
area_of_tension_crack = ClusterInput()  # m2
unit_weight_of_rock = ClusterInput()  # MN/m3
wedge_volume = ClusterInput()  # m3
vertical_height_of_line_of_intersection = ClusterInput()  # m

# ---- group: Joint properties
cohesion_of_joint_1 = ClusterInput()  # MPa
friction_angle_of_joint_1 = ClusterInput()  # degree
cohesion_of_joint_2 = ClusterInput()
friction_angle_of_joint_2 = ClusterInput()  # degree

# ---- group: Seismic
direction_of_seismic_force = ClusterInput()
k = ClusterInput()

# ---- group: External Forces
individual_external_force_vectors = ClusterInput()

# ---- group: Water
joint_water_pressure = ClusterInput()  # No water pressure = 0 Constant water pressure = 1 Filled pressure (No Tension Crack) = 2 Filled pressure (With Tension Crack) = 3
percentage_fill = ClusterInput()  # 0 to 100.
constant_pressure_on_joint_1 = ClusterInput()  # MPa
constant_pressure_on_joint_2 = ClusterInput()  # MPa
constant_pressure_on_tension_crack = ClusterInput()  # MPa
percentage_fill_2 = Number(percentage_fill)
joint_water_pressure_2 = Integer(joint_water_pressure)

# ---- group: Bolt
capcaity_of_active_bolt = ClusterInput()  # MN
unit_direction_of_active_bolt = ClusterInput()
capacity_of_passive_bolt = ClusterInput()  # MN
unit_direction_of_passive_bolt = ClusterInput()

# ---- group: Shotcrete
trace_length_of_joint_1_on_slope_face = ClusterInput()  # m
trace_length_of_joint_2_on_slope_face = ClusterInput()  # m
shotcrete_thickness = ClusterInput()  # m
shotcrete_shear_strength = ClusterInput()  # MPa

# ---- group: Active support pressure
active_pressure_magnitude_on_slope_face = ClusterInput()  # MPa
trend_plunge_of_active_slope_pressure = ClusterInput()
active_pressure_magnitude_on_upper_face = ClusterInput()  # MPa
trend_plunge_of_active_upper_face_pressu = ClusterInput()

# ---- group: Passive support pressure
passive_pressure_magnitude_on_slope_face = ClusterInput()  # MPa
trend_plunge_of_passive_slope_pressure = ClusterInput()
passive_pressure_magnitude_on_upper_face = ClusterInput()  # MPa
trend_plunge_of_passive_upper_face_press = ClusterInput()

# ---- group: 3.1k - Active Bolt Force Vector
e_cap_bolt_active = Vector(unitize(unit_direction_of_active_bolt))
c_active = Number(capcaity_of_active_bolt)
multiplication = Multiplication(A=c_active, B=e_cap_bolt_active)
mass_addition = MassAddition(Input=multiplication)  # -> Result, PartialResults
b_a = Vector(mass_addition.Result)

# ---- group: 3.1b - Wedge Weight Vector
gamma_r = Number(unit_weight_of_rock)
g_cap = Vector("{0,0,-1}")
V = Number(wedge_volume)
expression = Expression(gamma_r=gamma_r, V=V, g_cap=g_cap, Expression="(gamma_r*V)•g_cap")
W = Vector(expression)

# ----
p_s_active = Number(active_pressure_magnitude_on_slope_face)

# ---- group: 3.1c - External Force Vector
c_i = Vector(individual_external_force_vectors)
mass_addition_2 = MassAddition(Input=flatten(c_i))  # -> Result, PartialResults
C = Vector(mass_addition_2.Result)

# ----
p_u_active = Number(active_pressure_magnitude_on_upper_face)

# ---- group: 3.1d - Pressure Force (Active) Vector
n_cap_s_active = Vector(unitize(trend_plunge_of_active_slope_pressure))
n_cap_u_active = Vector(unitize(trend_plunge_of_active_upper_face_pressu))
a_s = Number(area_2.Area)
a_u = Number(area_4.Area)
_3_1d_pressure_force_active_vector = Expression(
    p_s_active=p_s_active,
    a_s=a_s,
    n_cap_s_active=n_cap_s_active,
    p_u_active=p_u_active,
    a_u=a_u,
    n_cap_u_active=n_cap_u_active,
    Expression="p_s_active*a_s*n_cap_s_active+p_u_active*a_u*n_cap_u_active")
X = Vector(_3_1d_pressure_force_active_vector)

# ---- group: 3.1j - Seismic Force Vector
e_cap_seismic = Vector(direction_of_seismic_force)
gamma_r_2 = Number(gamma_r)
# Pond Water Pressure not included.
k_2 = Number(k)
expression_2 = Expression(k=k_2, gamma_r=gamma_r_2, V=V, e_cap_seismic=e_cap_seismic, Expression="(k*gamma_r*V)•e_cap_seismic")
E = Vector(expression_2)

# ---- group: 3.1e - Constant Pressure on Each Joint / Left joint
n_cap_1 = Vector(unitize(dip_dipdirection_to_plane.plane_normal_2))
u_1 = Number(constant_pressure_on_joint_1)
a_1 = Number(area.Area)

# ---- group: 3.1e - Constant Pressure on Each Joint / Right joint
n_cap_2 = Vector(unitize(dip_dipdirection_to_plane_2.plane_normal_2))
u_2 = Number(constant_pressure_on_joint_2)
a_2 = Number(area_3.Area)

# ---- group: 3.1e - Constant Pressure on Each Joint / Tension crack
n_cap_t = Vector(unitize(dip_dipdirection_to_plane_4.plane_normal_2))
u_t = Number(constant_pressure_on_tension_crack)
a_t = Number(area_of_tension_crack)

# ---- group: Right joint
n_cap_2_2 = Vector(n_cap_2)
a_2_2 = Number(a_2)

# ----
p = Number(percentage_fill_2)

# ---- group: Left joint
a_1_2 = Number(a_1)
n_cap_1_2 = Vector(n_cap_1)

n_cap_1_3 = Vector(n_cap_1)
a_1_3 = Number(a_1)

# ----
gamma_w = Number("0.00981")
h_w = Number(vertical_height_of_line_of_intersection)

# ---- group: Right joint
n_cap_2_3 = Vector(n_cap_2)
a_2_3 = Number(a_2)

# ---- group: Tension Crack
a_t_2 = Number(a_t)
n_cap_t_2 = Vector(n_cap_t)

# ----
expression_3 = Expression(u_2=u_2, a_2=a_2, n_cap_2=n_cap_2, Expression="u_2*a_2*n_cap_2")
expression_4 = Expression(u_1=u_1, a_1=a_1, n_cap_1=n_cap_1, Expression="u_1*a_1*n_cap_1")
expression_5 = Expression(u_t=u_t, a_t=a_t, n_cap_t=n_cap_t, Expression="u_t*a_t*n_cap_t")

# ---- group: 3.1e - Constant Pressure on Each Joint
mass_addition_3 = MassAddition(Input=flatten([expression_4, expression_3, expression_5]))  # -> Result, PartialResults
U = Vector(mass_addition_3.Result)

# ---- group: 3.2b - Pressure Force (Passive) Vector
n_cap_s_passive = Vector(unitize(trend_plunge_of_passive_slope_pressure))
n_cap_u_passive = Vector(unitize(trend_plunge_of_passive_upper_face_press))
p_s_passive = Number(passive_pressure_magnitude_on_slope_face)
p_u_passive = Number(passive_pressure_magnitude_on_upper_face)
_3_1d_pressure_force_active_vector_2 = Expression(
    p_s_passive=p_s_passive,
    a_s=a_s,
    n_cap_s_passive=n_cap_s_passive,
    p_u_passive=p_u_passive,
    a_u=a_u,
    n_cap_u_passive=n_cap_u_passive,
    Expression="p_s_passive*a_s*n_cap_s_passive+p_u_passive*a_u*n_cap_u_passive")
H = Vector(_3_1d_pressure_force_active_vector_2)

# ---- group: 3.2d - Passive Bolt Force Vector
e_cap_bolt_passive = Vector(unitize(unit_direction_of_passive_bolt))
c_passive = Number(capacity_of_passive_bolt)
multiplication_2 = Multiplication(A=c_passive, B=e_cap_bolt_passive)
mass_addition_4 = MassAddition(Input=multiplication_2)  # -> Result, PartialResults
b_p = Vector(mass_addition_4.Result)

# ---- group: 3.2c Shotcrete Shear Resistance
n_cap_s = Vector(unitize(dip_dipdirection_to_plane_3.plane_normal_2))
l_1 = Number(trace_length_of_joint_1_on_slope_face)
t = Number(shotcrete_thickness)
tau_s = Number(shotcrete_shear_strength)
l_2 = Number(trace_length_of_joint_2_on_slope_face)
expression_6 = Expression(L_1=l_1, L_2=l_2, t=t, tau_s=tau_s, n_cap_s=n_cap_s, Expression="(L_1+L_2)*t*tau_s*n_cap_s")
Y = Vector(expression_6)

# ---- group: 3.1a - Active Force Vector / 3.2a - Passive Force Vector
# 3.2 Passive Force Vector
H_2 = Vector(H)
Y_2 = Vector(Y)
b_p_2 = Vector(b_p)
expression_7 = Expression(H=H_2, Y=Y_2, B_p=b_p_2, Expression="H+Y+B_p")
P = Vector(expression_7)

# ---- group: 3.1a - Active Force Vector
b_a_2 = Vector(b_a)
# 3.1 Active Force Vector
W_2 = Vector(W)
C_2 = Vector(C)
X_2 = Vector(X)
E_2 = Vector(E)

# ---- group: 3.1g - Gravitational Pressure (With Tension Crack)
expression_8 = Expression(p=p, gamma_w=gamma_w, H_w=h_w, Expression="(p/100)³*gamma_w*H_w")
mass_multiplication = MassMultiplication(Input=flatten([a_1_3, expression_8, n_cap_1_3]))  # -> Result, PartialResults
mass_multiplication_2 = MassMultiplication(Input=flatten([expression_8, a_2_3, n_cap_2_3]))  # -> Result, PartialResults
mass_multiplication_3 = MassMultiplication(Input=flatten([a_t_2, expression_8, n_cap_t_2]))  # -> Result, PartialResults
mass_addition_5 = MassAddition(Input=flatten([mass_multiplication.Result, mass_multiplication_2.Result, mass_multiplication_3.Result]))  # -> Result, PartialResults

# ----
multiplication_3 = Multiplication(A=mass_addition_5.Result, B="1/3")

# ---- group: 3.1g - Gravitational Pressure (With Tension Crack) (continued)
U_2 = Vector(multiplication_3)

# ---- group: 3.1f - Gravitational Pressure (No Tension Crack)
expression_9 = Expression(p=p, gamma_w=gamma_w, H_w=h_w, Expression="(p/100)³*gamma_w*H_w")
mass_multiplication_4 = MassMultiplication(Input=flatten([a_1_2, expression_9, n_cap_1_2]))  # -> Result, PartialResults
mass_multiplication_5 = MassMultiplication(Input=flatten([a_2_2, expression_9, n_cap_2_2]))  # -> Result, PartialResults
mass_addition_6 = MassAddition(Input=flatten([mass_multiplication_4.Result, mass_multiplication_5.Result]))  # -> Result, PartialResults

# ----
multiplication_4 = Multiplication(A=mass_multiplication_4.Result, B="1/6")
multiplication_5 = Multiplication(A=mass_multiplication_5.Result, B="1/6")
multiplication_6 = Multiplication(A=mass_addition_6.Result, B="1/6")
vector_length = VectorLength(Vector=multiplication_4)
vector_length_2 = VectorLength(Vector=multiplication_5)

# ---- group: 3.1f - Gravitational Pressure (No Tension Crack) (continued)
U_3 = Vector(multiplication_6)

# ----
joint_1_water_force = Panel(vector_length)
joint_1_water_force_2 = Panel(vector_length_2)
pick_n_choose = PickNChoose(Pattern=joint_water_pressure_2, Stream0="{0,0,0}", Stream1=U, Stream2=U_3, Stream3=U_2)
U_4 = Vector(pick_n_choose)

# ---- group: 3.1a - Active Force Vector (continued)
U_5 = Vector(U_4)
expression_10 = Expression(W=W_2, C=C_2, X=X_2, U=U_5, E=E_2, B_a=b_a_2, Expression="W+C+X+U+E+B_a")
A = Vector(expression_10)

# ---- group: Case 1
expression_11 = Expression(A=A, n_cap_1=n_cap_1, Expression="A•n_cap_1")
case1 = Number(expression_11)

# ---- group: Case 2
expression_12 = Expression(A=A, n_cap_2=n_cap_2, Expression="A•n_cap_2")
case2 = Number(expression_12)

# ---- group: 4a - Lifting
# 4. Sliding Direction
A_2 = Vector(A)
s_cap_0 = Vector(unitize(A_2))

# ---- group: Case 3
expression_13 = Expression(A=A, W=W, Expression="A•W")
case3 = Number(expression_13)

# ---- group: 4b - Sliding on a Single Face
expression_14 = Expression(n_cap_1=n_cap_1, A=A, Expression="(n_cap_1┴A)┴n_cap_1")
expression_15 = Expression(n_cap_2=n_cap_2, A=A, Expression="(n_cap_2┴A)┴n_cap_2")
s_cap_1 = Vector(unitize(expression_14))
s_cap_2 = Vector(unitize(expression_15))

# ---- group: Case 5
expression_16 = Expression(s_cap_2=s_cap_2, n_cap_1=n_cap_1, Expression="s_cap_2•n_cap_1")
case5 = Number(expression_16)

# ---- group: Case 4
expression_17 = Expression(s_cap_1=s_cap_1, n_cap_2=n_cap_2, Expression="s_cap_1•n_cap_2")
case4 = Number(expression_17)

# ----
# 1 = Lifting Wedge
# 2 = Sliding on Joint 1
# 3 = Sliding on Joint 2
# 4 = Sliding on the Intersection of Joint 1 and Joint 2
expression_18 = Expression(case1=case1, case2=case2, case3=case3, Expression="if(case1>0, 1, 0)*if(case2>0, 1, 0)*if(case3<0, 1, 0)*1")
expression_19 = Expression(case1=case1, case4=case4, Expression="if(case1≤0, 1, 0)*if(case4>0, 1, 0)*2")
expression_20 = Expression(case2=case2, case5=case5, Expression="if(case2≤0, 1, 0)*if(case5>0, 1, 0)*3")
expression_21 = Expression(case4=case4, case5=case5, Expression="if(case4≤0, 1, 0)*if(case5≤0, 1, 0)*4")
mass_addition_7 = MassAddition(Input=flatten([expression_18, expression_21, expression_19, expression_20]))  # -> Result, PartialResults
sliding_direction = Integer(mass_addition_7.Result)

# ----
# "the force vector, F, is generally either
# the active or the passive resultant force vector".
# 
# How to determine this?
expression_22 = Expression(A=A, P=P, Expression="A+P")
F = Vector(expression_22)

# ---- group: 5a to 5d - Normal Force
# 5. Normal Force
sliding_direction_2 = Integer(sliding_direction)
expression_23 = Expression(
    F=F,
    n_cap_1=n_cap_1,
    n_cap_2=n_cap_2,
    Expression="-((F┴n_cap_2)•(n_cap_1┴n_cap_2))/((n_cap_1┴n_cap_2)•(n_cap_1┴n_cap_2))")
expression_24 = Expression(
    F=F,
    n_cap_1=n_cap_1,
    n_cap_2=n_cap_2,
    Expression="-((F┴n_cap_1)•(n_cap_2┴n_cap_1))/((n_cap_2┴n_cap_1)•(n_cap_2┴n_cap_1))")
expression_25 = Expression(F=F, n_cap_1=n_cap_1, Expression="-F•n_cap_1")
expression_26 = Expression(F=F, n_cap_2=n_cap_2, Expression="-F•n_cap_2")
_0 = Number(0)
n_1 = Number(expression_23)
n_2 = Number(expression_24)
stream_filter = StreamFilter(Gate=sliding_direction_2, Stream0=_0, Stream1=_0, Stream2=expression_25, Stream3=_0, Stream4=n_1)
stream_filter_2 = StreamFilter(Gate=sliding_direction_2, Stream0=_0, Stream1=_0, Stream2=_0, Stream3=expression_26, Stream4=n_2)
n_2_2 = Number(stream_filter_2)
n_1_2 = Number(stream_filter)

# ---- group: 6.1a - Normal stress on Each Joint
expression_27 = Expression(N_2=n_2_2, a_2=a_2, Expression="N_2/a_2")
expression_28 = Expression(N_1=n_1_2, a_1=a_1, Expression="N_1/a_1")
sigma_n_2 = Number(expression_27)
sigma_n_1 = Number(expression_28)

# ---- group: 6.1b -Shear Strength of Each Joint (Mohr-Coulomb)
phi_1 = Number(friction_angle_of_joint_1)
phi_2 = Number(friction_angle_of_joint_2)
c_1 = Number(cohesion_of_joint_1)
c_2 = Number(cohesion_of_joint_2)
radians = Radians(Degrees=phi_1)
radians_2 = Radians(Degrees=phi_2)
expression_29 = Expression(c_1=c_1, sigma_n_1=sigma_n_1, Phi_1=radians, Expression="c_1+sigma_n_1*tan(Phi_1)")
expression_30 = Expression(c_2=c_2, sigma_n_2=sigma_n_2, Phi_2=radians_2, Expression="c_2+sigma_n_2*tan(Phi_2)")
tau_2 = Number(expression_30)
tau_1 = Number(expression_29)
stream_filter_3 = StreamFilter(Gate=sliding_direction_2, Stream0=_0, Stream1=_0, Stream2=tau_1, Stream3=_0, Stream4=tau_1)
stream_filter_4 = StreamFilter(Gate=sliding_direction_2, Stream0=_0, Stream1=_0, Stream2=_0, Stream3=tau_2, Stream4=tau_2)
tau_1_2 = Number(stream_filter_3)
tau_2_2 = Number(stream_filter_4)

# ----
s_cap_0_2 = Vector(s_cap_0)

# ---- group: 7b - Lifting Factor of Safety
expression_31 = Expression(P=P, A=A, s_cap_0=s_cap_0_2, Expression="(-P•s_cap_0)/(A•s_cap_0)")
fs_f = Number(expression_31)

# ---- group: 4c - Sliding on a Two Faces
expression_32 = Expression(n_cap_1=n_cap_1, n_cap_2=n_cap_2, A=A, Expression="(n_cap_1┴n_cap_2)•A")

# ----
expression_33 = Expression(x=expression_32, Expression="if(x>0,1,if(x<0,-1,0))")

# ---- group: 4c - Sliding on a Two Faces (continued)
expression_34 = Expression(n_cap_1=n_cap_1, n_cap_2=n_cap_2, sign=expression_33, Expression="(n_cap_1┴n_cap_2)*sign")
s_cap_12 = Vector(unitize(expression_34))

# ---- group: Sliding direction
s_cap_1_2 = Vector(s_cap_1)
s_cap_2_2 = Vector(s_cap_2)
# 6. Shear Strength
s_cap_12_2 = Vector(s_cap_12)
stream_filter_5 = StreamFilter(Gate=sliding_direction_2, Stream2=s_cap_1_2, Stream3=s_cap_2_2, Stream4=s_cap_12_2)
s_cap = Vector(stream_filter_5)

# ---- group: Driving force
A_3 = Expression(A=A, s_cap=s_cap, Expression="A•s_cap")

# ---- group: theta_1
angle = Angle(VectorA=s_cap, VectorB=deconstruct_plane.YAxis)  # -> Angle, Reflex
theta_1 = Number(angle.Angle)

# ----
driving_force = Panel(A_3)

# ---- group: theta_2
angle_2 = Angle(VectorA=s_cap, VectorB=deconstruct_plane_2.YAxis)  # -> Angle, Reflex
theta_2 = Number(angle_2.Angle)

# ---- group: 6.1e - Resisting Force due to Shear Strength
# *** cos(theta_1) or cos(theta_2) not included as written in the Theory Manual?
expression_35 = Expression(tau_2=tau_2_2, a_2=a_2, theta_2=theta_2, Expression="tau_2*a_2")
expression_36 = Expression(tau_1=tau_1_2, a_1=a_1, theta_1=theta_1, Expression="tau_1*a_1")
j_2 = Number(expression_35)
j_1 = Number(expression_36)

# ----
addition = Addition(A=j_1, B=j_2)
resisting_force = Panel(addition)

# ----
# Returns FS = 1 if s_cap is {0,0,0}
vector_length_3 = VectorLength(Vector=s_cap)
equality = Equality(FirstNumber=vector_length_3, SecondNumber="0")  # -> Equality, Inequality
sliding_direction_3 = ClusterOutput(sliding_direction)
integer = Integer(equality.Equality)

# ---- group: 7d - Supported Factor of Safety
# New definition of FS (Li & Høien 2023)
expression_37 = Expression(
    F=F,
    H=H,
    Y=Y,
    B_p=b_p,
    B_a=b_a,
    X=X,
    W=W,
    C=C,
    U=U_4,
    E=E,
    s_cap=s_cap,
    J_1=j_1,
    J_2=j_2,
    Expression="(J_1+J_2-((H+Y+C+B_p+B_a+X)•s_cap))/((W+U+E)•s_cap)")
fs_s = Number(expression_37)

# ---- group: 7a - Factor of Safety
# 7. Factor of Safety
fs_f_2 = Number(fs_f)
fs_u = Number()
fs_s_2 = Number(fs_s)
entwine = Entwine(Branch00=fs_f_2, Branch01=fs_u, Branch02=fs_s_2, Branch03=integer, FlattenInputs=True)  # -> flatten(Result)
sort_list = SortList(Keys=entwine, ValuesValuesA=entwine)  # -> Keys, reverse(ValuesValuesA)
first_last = FirstLast(List=sort_list.ValuesValuesA)  # -> FirstValue, LastValue
fs = Number(first_last.FirstValue)

# ----
factor_of_safety = ClusterOutput(fs)

# ==== cluster ReOrientCutterPlane
point_in_wedge = ClusterInput()
cutter_plane = ClusterInput()
cutter_plane_2 = Plane(cutter_plane)
point_in_wedge_2 = Point(point_in_wedge)
move_to_plane = MoveToPlane(Geometry=point_in_wedge_2, Plane=cutter_plane_2, Above="True", Below="False")  # -> Geometry, Transform
text = Text(move_to_plane.Transform)
flip_plane = FlipPlane(Plane=cutter_plane_2, FlipX=False, FlipY=False, FlipZ=True)  # -> Flipped, ResultBoolean
merge = Merge(Data1="Identity", Data2=text)  # -> flatten(Result)
stringduplicates = StringDuplicates(String=merge)  # -> String, Integer, String_2
first_last = FirstLast(List=stringduplicates.String_2)  # -> FirstValue, LastValue
pick_n_choose = PickNChoose(Pattern=first_last.LastValue, Stream0=flip_plane.Flipped, Stream1=cutter_plane_2)
plane_below_point_in_wedge = Plane(pick_n_choose)
plane_below_point_in_wedge_2 = ClusterOutput(plane_below_point_in_wedge)
